# Grasshopper definition HistoricDomeDataset.gh (Grasshopper 1.0.7)
# plug-ins: EleFront

number = Number(-2)
xy_plane = XYPlane(Origin=Point(0, 0, 0))

# ----
# Export & General Parameters
# To export a Geometry Set Toggle to "True"
# After each mofication geometries will be exported.
transition_element_type = ValueList({"Pendentive": 0, "Planar Triangular Band": 1, "Basic Prismatic Band": 2, "Complex Prismatic Band": 3, "Turkish Triangle": 4, "Corner Triangle": 5, "Squinch": 6, "Triple Squinch": 7}, selected="Turkish Triangle")
arch_type = ValueList({"Semicircular": 0, "Pointed": 1, "Flat": 2, "Single Centered Tangential": 3, "Double Centered Tangential": 4}, selected="Single Centered Tangential")
dome_flatness_ratio = Slider(0.82, range=0..1)
polygon_edge_nubmer = Slider(32, range=0..48)
dome_type = ValueList({"Semi   Sphere": 0, "Cutted Sphere": 1}, selected="Cutted Sphere")
drum_or_direct = ValueList({"With Drum": 0, "Direct": 1}, selected="Direct")
w2_arch_or_wall = ValueList({"Wall": 0, "Arch": 1}, selected="Arch")
w1_arch_or_wall = ValueList({"Wall": 0, "Arch": 1}, selected="Wall")
w3_arch_or_wall = ValueList({"Wall": 0, "Arch": 1}, selected="Arch")
w4_arch_or_wall = ValueList({"Wall": 0, "Arch": 1}, selected="Arch")
wall_width = Slider(1000, range=0..1000)
heigth_of_the_walls = Slider(1000, range=0..1000)
drum_heigth = Slider(60, range=0..200)
export_toggle = BooleanToggle(False)
bake_all_elefront = BakeAllElefront(False)

wall_width_2 = Number(wall_width)
division = Division(A=wall_width_2, B=number)
vector_xyz = VectorXYZ(XComponent=division, YComponent=division, ZComponent=0)  # -> Vector, Length
rectangle = Rectangle(Plane=xy_plane, XSize=wall_width_2, YSize=wall_width_2, Radius=0)  # -> Rectangle, Length
move = Move(Geometry=rectangle.Rectangle, Motion=vector_xyz.Vector)  # -> Geometry, Transform
rectangle_2 = Rectangle(move.Geometry)
wall_height = Number(heigth_of_the_walls)
unit_z = UnitZ(Factor=wall_height)

# ----
# Drum Polygon Fitting
# https://discourse.mcneel.com/t/circumscribed-polygon/72921/3
wall_upper_rectangle = Move(Geometry=rectangle_2, Motion=unit_z)  # -> Geometry, Transform
explode = Explode(Curve=wall_upper_rectangle.Geometry, Recursive=True)  # -> Segments, Vertices
expression = Expression(x=transition_element_type, Expression="if(x=0,0,if(x=5,2,if(x=7,3,if(x=6,3,1))))")
list_item = ListItem(List=explode.Segments, Index=Slider(0, range=0..100), Wrap=True)
area = Area(Geometry=wall_upper_rectangle.Geometry)  # -> Area, Centroid
length = Length(Curve=list_item)
division_2 = Division(A=length, B=Slider(2, range=0..10))
xy_plane_2 = XYPlane(Origin=Point(0, 0, 0))
plane_origin = PlaneOrigin(Base=xy_plane_2, Origin=area.Centroid)
triple_trump = Panel("""8
16""")
pendentive_control = StreamFilter(Gate=expression, Stream0=4, Stream1=polygon_edge_nubmer, Stream2=8, Stream3=triple_trump)  # -> simplify(Stream)
circle = Circle(Plane=plane_origin, Radius=division_2)
multiplication = Multiplication(A=pendentive_control, B=Slider(2, range=0..10))
horizontal_frames = HorizontalFrames(Curve=circle, Count=multiplication)  # -> Frames, Parameters
panel = Panel("""True
False""")
cull_pattern = CullPattern(List=horizontal_frames.Frames, CullPattern=panel)
deconstruct_plane = DeconstructPlane(Plane=cull_pattern)  # -> Origin, XAxis, YAxis, ZAxis
adjust_plane = AdjustPlane(Plane=cull_pattern, Normal=deconstruct_plane.YAxis)
plane_region = PlaneRegion(Plane=plane_origin, Bounds=adjust_plane)

# ----
# WALL EDGES
number_slider = Slider(4, range=0..10)
explode_2 = Explode(Curve=rectangle_2, Recursive=True)  # -> Segments, Vertices
wall_bottom_corners = CullIndex(List=explode_2.Vertices, Indices=Slider(4, range=0..10), Wrap=True)
wall_top_corners = CullIndex(List=explode.Vertices, Indices=number_slider, Wrap=True)
wall_edges = Line(StartPoint=wall_bottom_corners, EndPoint=wall_top_corners)

# ----
# WALL NORMALS
number_slider_2 = Slider(3, range=0..10)
loft_options = LoftOptions(Closed=False, Adjust=False, Rebuild=0, Refit=0, Type=number_slider_2)
list_item_2 = ListItem(List=wall_edges, Index=Slider(0, range=0..10), Wrap=True)
loft = Loft(Curves=flatten([wall_edges, list_item_2]), Options=loft_options)
deconstruct_brep = DeconstructBrep(Brep=loft)  # -> Faces, Edges, Vertices
deconstruct_plane_2 = DeconstructPlane(Plane=flatten(deconstruct_brep.Faces))  # -> Origin, XAxis, YAxis, ZAxis

# ---- group: Sivri Kemer
proportion_of_the_center_of_the_arcs_ove = Slider(1.5, range=0..2.5)  # "Proportion of the Center of the arcs over 5"
thickness_of_the_archs = Slider(100, range=0..100)
depth_from_the_corner = Slider(100, range=0..100)
heigth_of_the_arc = Slider(183, range=0..600)
pointed_arch_sivri_kemer = PointedArchSivriKemer(
    wall_upper_boundary=wall_upper_rectangle.Geometry,
    thickness_of_the_archs=thickness_of_the_archs,
    arch_centers_5=proportion_of_the_center_of_the_arcs_ove,
    wall_bottom_points=wall_bottom_corners,
    wall_edges=wall_edges,
    inner_distance_form_corner_ovver_the_wal=depth_from_the_corner,
    heigth_of_the_arc=heigth_of_the_arc,
    face_normals=deconstruct_plane_2.ZAxis,
    arch_thickness=Slider(100, range=0..100),
    height_of_the_wall=heigth_of_the_walls)  # -> breps_2, breps_3, breps, breps_4

# ----
# Directory
panel_2 = Panel("C:\Users\leche\OneDrive\Thesis\Domes_And_Sub_Elements\Dataset2")
file_path = FilePath(panel_2)

# ----
# Archs
depth_from_the_corner_2 = Slider(130, range=0..200)
thickness_of_the_arc = Slider(120, range=0..200)
depth_from_the_corner_3 = Slider(181, range=0..200)

# ---- group: Çift Merkezli Teğet Kemer
proportion_of_the_center_of_the_arcs_ove_2 = Slider(4, range=2.5..4.5)  # "Proportion of the Center of the arcs over 5"
heigth_of_the_arc_2 = Slider(470, range=0..600)
# Kas Kemer
cift_merkezli_teget_kemer = PointedArchSivriKemer(
    wall_upper_boundary=wall_upper_rectangle.Geometry,
    thickness_of_the_archs=depth_from_the_corner_2,
    arch_centers_5=proportion_of_the_center_of_the_arcs_ove_2,
    wall_bottom_points=wall_bottom_corners,
    wall_edges=wall_edges,
    inner_distance_form_corner_ovver_the_wal=depth_from_the_corner_3,
    heigth_of_the_arc=heigth_of_the_arc_2,
    face_normals=deconstruct_plane_2.ZAxis,
    arch_thickness=thickness_of_the_arc,
    height_of_the_wall=heigth_of_the_walls)  # -> breps_2, breps_3, breps, breps_4

# ---- group: Tek Merkezli Teğet Kemer
depth_from_the_corner_4 = Slider(100, range=0..200)
depth_of_the_archs = Slider(100, range=0..200)
heigth_of_the_arc_3 = Slider(338, range=0..600)
tek_merkezli_teget_kemer = SemicirclarArchYarımDaire(
    wall_edges=wall_edges,
    wall_bottom_corners=wall_bottom_corners,
    depth_from_the_corner=depth_from_the_corner_4,
    height_of_the_arc=heigth_of_the_arc_3,
    depth_of_the_ach=depth_of_the_archs,
    wall_length=wall_width,
    arch_thickness=Slider(73, range=0..100))  # -> breps_2, breps_3, breps, breps_4

# ----
depth_from_the_corner_5 = Slider(100, range=0..100)
depth_of_the_archs_2 = Slider(100, range=0..100)
heigth_of_the_arc_4 = Slider(271, range=0..600)
semicirclar_arch_yarım_daire = SemicirclarArchYarımDaire(
    wall_edges=wall_edges,
    wall_bottom_corners=wall_bottom_corners,
    depth_from_the_corner=depth_from_the_corner_5,
    height_of_the_arc=heigth_of_the_arc_4,
    depth_of_the_ach=depth_of_the_archs_2,
    wall_length=wall_width,
    arch_thickness=Slider(100, range=0..100))  # -> breps_2, breps_3, breps, breps_4

# ---- group: Basık kemer
depth_from_the_corner_6 = Slider(150, range=0..200)
depth_of_the_archs_3 = Slider(150, range=0..200)
arch_thicknes = Slider(90, range=0..100)
heigth_of_the_arc_5 = Slider(278, range=0..600)
number_slider_3 = Slider(1, range=0..1)
flat_arch_basık_kemer = FlatArchBasıkKemer(
    wall_edges=wall_edges,
    wall_bottom_corners=wall_bottom_corners,
    depth_from_the_corner=depth_from_the_corner_6,
    height_of_the_arc=heigth_of_the_arc_5,
    depth_of_arch=depth_of_the_archs_3,
    wall_length=heigth_of_the_walls,
    flatness_factor=number_slider_3,
    quarter_circle_or_free=Toggle(False),
    arch_thickness=arch_thicknes)  # -> breps_2, breps_3, breps, breps_4

# ---- group: Since there are 2
expression_2 = Expression(x=transition_element_type, Expression="if(x=7,1,0)")
list_item_3 = ListItem(List=flatten(plane_region), Index=Slider(1, range=0..1), Wrap=True)
drum_type = StreamFilter(Gate=expression_2, Stream0=plane_region, Stream1=list_item_3)

# ----
# WALL CREATION
boolean_toggle = BooleanToggle(False)
loft_options_2 = LoftOptions(Closed=False, Adjust=boolean_toggle, Rebuild=boolean_toggle, Refit=0, Type=0)
loft_2 = Loft(Curves=[rectangle_2, wall_upper_rectangle.Geometry], Options=loft_options_2)

stream_filter = StreamFilter(
    Gate=arch_type,
    Stream0=semicirclar_arch_yarım_daire.breps_2,
    Stream1=pointed_arch_sivri_kemer.breps_2,
    Stream2=flat_arch_basık_kemer.breps_2,
    Stream3=tek_merkezli_teget_kemer.breps_2,
    Stream4=cift_merkezli_teget_kemer.breps_2)
stream_filter_2 = StreamFilter(
    Gate=arch_type,
    Stream0=semicirclar_arch_yarım_daire.breps_4,
    Stream1=pointed_arch_sivri_kemer.breps_4,
    Stream2=flat_arch_basık_kemer.breps_4,
    Stream3=tek_merkezli_teget_kemer.breps_4,
    Stream4=cift_merkezli_teget_kemer.breps_4)
stream_filter_3 = StreamFilter(
    Gate=arch_type,
    Stream0=semicirclar_arch_yarım_daire.breps_3,
    Stream1=pointed_arch_sivri_kemer.breps_3,
    Stream2=flat_arch_basık_kemer.breps_3,
    Stream3=tek_merkezli_teget_kemer.breps_3,
    Stream4=cift_merkezli_teget_kemer.breps_3)
stream_filter_4 = StreamFilter(
    Gate=arch_type,
    Stream0=semicirclar_arch_yarım_daire.breps,
    Stream1=pointed_arch_sivri_kemer.breps,
    Stream2=flat_arch_basık_kemer.breps,
    Stream3=tek_merkezli_teget_kemer.breps,
    Stream4=cift_merkezli_teget_kemer.breps)
brep = Brep()
brep_2 = Brep()
brep_3 = Brep()
brep_4 = Brep()
stream_filter_5 = StreamFilter(Gate=w2_arch_or_wall, Stream0=brep, Stream1=stream_filter_3)
stream_filter_6 = StreamFilter(Gate=w4_arch_or_wall, Stream0=brep_3, Stream1=stream_filter_2)
stream_filter_7 = StreamFilter(Gate=w1_arch_or_wall, Stream0=brep_4, Stream1=stream_filter)
stream_filter_8 = StreamFilter(Gate=w3_arch_or_wall, Stream0=brep_2, Stream1=stream_filter_4)

stream_filter_9 = StreamFilter(Gate=w3_arch_or_wall, Stream0="W", Stream1="A")
stream_filter_10 = StreamFilter(Gate=w1_arch_or_wall, Stream0="W", Stream1="A")
stream_filter_11 = StreamFilter(Gate=w2_arch_or_wall, Stream0="W", Stream1="A")
stream_filter_12 = StreamFilter(Gate=w4_arch_or_wall, Stream0="W", Stream1="A")

# ----
# NAMING CONVENTION
panel_3 = Panel("POINTED")
pointed_r = Concatenate(Fragment_A=panel_3, A="_", Fragment_B=proportion_of_the_center_of_the_arcs_ove)
flat_r = Concatenate(Fragment_A="FLAT", A="_", Fragment_B=number_slider_3)
multiplication_2 = Multiplication(A=dome_flatness_ratio, B="100")
drum_h = Concatenate(Fragment_A="D2", A="_", Fragment_B=drum_heigth)
flatdome = Concatenate(FragmentA="FLATDOME_", FragmentB=multiplication_2)
wall_or_arc = Concatenate(Fragment_A=stream_filter_10, Fragment_B=stream_filter_11, A=stream_filter_9, B=stream_filter_12)
transitien_elements = StreamFilter(
    Gate=transition_element_type,
    Stream0="PD",
    Stream1="TB1",
    Stream2="TB2",
    Stream3="TB3",
    Stream4="TT",
    Stream5="CT",
    Stream6="S1",
    Stream7="S2")
with_drum_or_not = StreamFilter(Gate=drum_or_direct, Stream0=drum_h, Stream1="D1")
arch_types = StreamFilter(Gate=arch_type, Stream0="SEMI", Stream1=pointed_r, Stream2=flat_r, Stream3="SINGLE_CENT_TAN", Stream4="DOUBLE_CENT_TAN")
dome_types = StreamFilter(Gate=dome_type, Stream0="FULLDOME", Stream1=flatdome)
concatenate = Concatenate(
    Fragment_A=transitien_elements,
    K="_",
    L=polygon_edge_nubmer,
    Fragment_B="_",
    A=with_drum_or_not,
    B="_",
    C=wall_or_arc,
    D="_",
    E=arch_types,
    F="_",
    G=dome_types,
    H="_",
    DOME_DIA=wall_width_2,
    J="_",
    WALL_HEIGHT=wall_height)
panel_4 = Panel(concatenate)

number_slider_4 = Slider(1000, range=0..1000)  # disabled
number_slider_5 = Slider(10000, range=0..10000)  # disabled
settings_custom = SettingsCustom(
    StitchSeams=True,
    SimplePlanes=False,
    Refine=True,
    MinCount=number_slider_4,
    MaxCount=number_slider_5,
    AspectRatio=20,
    MaxDistance=0,
    MaxAngle=20,
    MinEdge=0,
    MaxEdge=0)  # disabled
brep_5 = Brep([stream_filter_7, stream_filter_5, stream_filter_8, stream_filter_6])
mesh_brep = MeshBrep(Brep=simplify(flatten(brep_5)), Settings=settings_custom)  # disabled
settings_quality = SettingsQuality()
mesh_brep_2 = MeshBrep(Brep=brep_5, Settings=settings_quality)
colour_picker = ColourPicker(PickedColour=RGB(255, 255, 255))
define_layer = DefineLayer(Name="ARCH", Color=colour_picker)
define_object_attributes = DefineObjectAttributes(Layer=define_layer, Color=colour_picker)
bake_objects = BakeObjects(Geometry=mesh_brep_2, Attributes=define_object_attributes, Bake=False)
custom_preview = CustomPreview(Geometry=mesh_brep_2, Material=colour_picker)

# ----
# Transition Elements
pendentive = Pendentive(
    wall_length=wall_width,
    wall_top_rectangle=explode.Vertices,
    x=pendentive_control,
    x_axis=deconstruct_plane_2.XAxis,
    drum_bottom_circle=circle,
    drum_bottom_polygon=plane_region,
    y_axis=deconstruct_plane_2.YAxis,
    guidecrv_bottom_drum_circle=circle,
    wall_normals=deconstruct_plane_2.ZAxis,
    bottom_drum_circle=circle,
    wall_top_triangle_sort_reference=wall_upper_rectangle.Geometry)
corner_triangle = CornerTriangle(wall_length=wall_width, bottom_drum_polygon=plane_region, wall_edges=wall_edges)
squinch = Squinch(corners_of_upper_wall=explode.Vertices, drum_bottom_bounds_8_16=plane_region, square_corners=wall_bottom_corners)  # -> breps, breps_2

# ----
# AREA BETWEEN THE DOME
#  AND THE TRIANGLE
number_slider_6 = Slider(2, range=0..100)
list_item_4 = ListItem(List=explode.Segments, Index=number_slider_6, Wrap=True)
list_item_5 = ListItem(List=explode.Segments, Index=Slider(0, range=0..100), Wrap=True)
loft_options_3 = LoftOptions(Closed=False, Adjust=Toggle(True), Rebuild=0, Refit=0, Type=0)
loft_3 = Loft(Curves=[list_item_4, list_item_5], Options=loft_options_3)
split_brep = SplitBrep(Brep=loft_3, Cutter=drum_type)
sphere_to_cut_plane = Sphere(Base=area.Centroid, Radius=division_2)
list_item_6 = ListItem(List=split_brep, Index=Slider(0, range=0..4), Wrap=True)
split_brep_2 = SplitBrep(Brep=list_item_6, Cutter=sphere_to_cut_plane)
number_slider_7 = Slider(0, range=0..10)  # disabled
area_between_bottom_drum_and_circle = CullIndex(List=split_brep_2, Indices=number_slider_7, Wrap=True)  # disabled

area_2 = Area(Geometry=split_brep_2)  # -> Area, Centroid
average = Average(Input=area_2.Area)
larger_than = LargerThan(FirstNumber=average, SecondNumber=split_brep_2)  # -> LargerThan, OrEqualTo
cull_pattern_2 = CullPattern(List=split_brep_2, CullPattern=larger_than.LargerThan)

area_between_bottom_drum_and_circle_2 = Surface(cull_pattern_2)

# ---- group: DRUM ELEMENTS
# Moved elements
unit_z_2 = UnitZ(Factor=drum_heigth)
drum_upper_border = Move(Geometry=drum_type, Motion=unit_z_2)  # -> Geometry, Transform
drum_center_point = Move(Geometry=area.Centroid, Motion=unit_z_2)  # -> Geometry, Transform
area_between_drum_poly_and_circle = Move(Geometry=area_between_bottom_drum_and_circle_2, Motion=unit_z_2)  # -> Geometry, Transform
drum_inner_circle = Move(Geometry=circle, Motion=unit_z_2)  # -> Geometry, Transform

# ----
turkish_band = TurkishBand(
    wall_upper_rectangle=wall_upper_rectangle.Geometry,
    drum_height_vector=unit_z_2,
    polygon_side_number=polygon_edge_nubmer,
    drum_upper_bound=drum_upper_border.Geometry)  # -> planar_turkish_band_2, complex_prismatic_turkish_band, basic_prismatic_turkish_band
turkish_triangle = TurkishTriangle(
    wall_top_rectangle_verices=explode.Vertices,
    polygon_edge_number=polygon_edge_nubmer,
    drum_top_polygon=drum_upper_border.Geometry,
    drum_height_vector=unit_z_2)

# ---- group: DOME
dome_form = DomeForm(
    drummer_upper_circle=drum_inner_circle.Geometry,
    dome_type=dome_type,
    dome_radius=division_2,
    dome_flatness_ratio=dome_flatness_ratio,
    drum_lower_circle=circle)  # -> dome_with_drum, dome_without_drum
dome_position = StreamFilter(Gate=drum_or_direct, Stream0=dome_form.dome_with_drum, Stream1=dome_form.dome_without_drum)

# ----
# If conditions for  Drum and Direct
polygon_drum = Loft(
    Curves=[drum_upper_border.Geometry, drum_type],
    Options={Adjust=False, Closed=False, LoftEnds=0, LoftSimp=0, LoftType=0, Rebuild=10, Refit=0.01})  # -> simplify(Loft)
cylinderic_drum = Loft(
    Curves=[circle, drum_inner_circle.Geometry],
    Options={Adjust=False, Closed=False, LoftEnds=0, LoftSimp=0, LoftType=0, Rebuild=10, Refit=0.01})
special_case_for_pendentive = Expression(x=transition_element_type, Expression="if(x=0,0,1)")
expression_3 = Expression(x=transition_element_type, Expression="if(x=0,0,1)")
drum_type_2 = StreamFilter(
    Gate=special_case_for_pendentive,
    Stream0=cylinderic_drum,
    Stream1=[polygon_drum, area_between_drum_poly_and_circle.Geometry])  # -> flatten(Stream)
drum_type_3 = StreamFilter(Gate=expression_3, Stream1=area_between_bottom_drum_and_circle_2)
drum_or_direct_2 = StreamFilter(Gate=drum_or_direct, Stream0=drum_type_2, Stream1=drum_type_3)

# ---- group: Transition Element Switch
transition_element = StreamFilter(
    Gate=transition_element_type,
    Stream0=pendentive,
    Stream1=turkish_band.planar_turkish_band_2,
    Stream2=turkish_band.basic_prismatic_turkish_band,
    Stream3=turkish_band.complex_prismatic_turkish_band,
    Stream4=turkish_triangle,
    Stream5=corner_triangle,
    Stream6=squinch.breps,
    Stream7=squinch.breps_2)
transition_element_surfaces = Brep(transition_element)

# ----
# CLIPPING THE TRANSITION
# ELEMENTS FROM WALLS
untrim = Untrim(Surface=transition_element_surfaces)
expression_4 = Expression(x=transition_element_type, Expression="if(x=0,0,1)")
brep_join = BrepJoin(Breps=untrim)  # -> Breps, Closed
stream_filter_13 = StreamFilter(Gate=expression_4, Stream0=brep_join.Breps, Stream1=transition_element_surfaces)  # -> simplify(Stream)
split_brep_multiple = SplitBrepMultiple(UntrimmedWalls=loft_2, Cutters=flatten(stream_filter_13))  # -> simplify(Result)
area_3 = Area(Geometry=split_brep_multiple)  # -> Area, Centroid
average_2 = Average(Input=area_3.Centroid)
deconstruct = Deconstruct(Point=area_3.Centroid)  # -> XComponent, YComponent, ZComponent
deconstruct_2 = Deconstruct(Point=average_2)  # -> XComponent, YComponent, ZComponent
expression_5 = Expression(x=transition_element_type, Expression="if(x=0,0,if(x=4,2,1))")
smaller_than = SmallerThan(FirstNumber=deconstruct.ZComponent, SecondNumber=deconstruct_2.ZComponent)  # -> SmallerThan, OrEqualTo
list_item_7 = ListItem(List=split_brep_multiple, Index=Slider(2, range=0..10), Wrap=True)  # -> simplify(Item)
list_item_8 = ListItem(List=split_brep_multiple, Index=Slider(0, range=0..10), Wrap=True)  # -> simplify(Item)
list_item_9 = ListItem(List=split_brep_multiple, Index=Slider(4, range=0..10), Wrap=True)  # -> simplify(Item)
cull_pattern_3 = CullPattern(List=split_brep_multiple, CullPattern=smaller_than.SmallerThan)
stream_filter_14 = StreamFilter(Gate=expression_5, Stream0=list_item_7, Stream1=list_item_8, Stream2=list_item_9)  # -> simplify(Stream)

# ----
# EXPLODE WALL FACES
# This part is written because face order of pendentive was currupted
deconstruct_brep_2 = DeconstructBrep(TrimmedWalls=cull_pattern_3)  # -> Faces, Edges, Vertices
area_4 = Area(Geometry=deconstruct_brep_2.Faces)  # -> Area, Centroid
sort_along_curve = SortAlongCurve(Points=area_4.Centroid, Curve=wall_upper_rectangle.Geometry)  # -> Points, Indices
panel_5 = Panel(sort_along_curve.Indices)
list_item_10 = ListItem(List=deconstruct_brep_2.Faces, Index=sort_along_curve.Indices, Wrap=True)
expression_6 = Expression(x=transition_element_type, Expression="if(x=0,0,1)")
shift_list = ShiftList(List=list_item_10, Shift=Slider(-1, range=-5..5), Wrap=True)
stream_filter_15 = StreamFilter(Gate=expression_6, Stream0=shift_list, Stream1=deconstruct_brep_2.Faces)  # -> simplify(Stream)
shift_list_2 = ShiftList(List=flatten(stream_filter_15), Shift=Slider(1, range=-4..4), Wrap=True)

# ----
# CLIPPING ARCHS FROM WALLS
number_slider_8 = Slider(2, range=0..10)
list_item_11 = ListItem(List=shift_list_2, Index=Slider(1, range=0..10), Wrap=True)
list_item_12 = ListItem(List=shift_list_2, Index=number_slider_8, Wrap=True)
list_item_13 = ListItem(List=shift_list_2, Index=Slider(3, range=0..10), Wrap=True)
list_item_14 = ListItem(List=shift_list_2, Index=Slider(0, range=0..10), Wrap=True)
split_brep_multiple_2 = SplitBrepMultiple(Brep=list_item_13, Cutters=flatten(stream_filter_6))  # -> flatten(Result)
split_brep_multiple_3 = SplitBrepMultiple(Brep=list_item_12, Cutters=flatten(stream_filter_8))  # -> flatten(Result)
split_brep_multiple_4 = SplitBrepMultiple(Brep=list_item_11, Cutters=flatten(stream_filter_5))  # -> flatten(Result)
split_brep_multiple_5 = SplitBrepMultiple(Brep=list_item_14, Cutters=flatten(stream_filter_7))  # -> flatten(Result)
stream_gate = StreamGate(Stream=split_brep_multiple_2, Gate=w4_arch_or_wall)  # -> Target0, Target1
stream_gate_2 = StreamGate(Stream=split_brep_multiple_3, Gate=w3_arch_or_wall)  # -> Target0, Target1
stream_gate_3 = StreamGate(Stream=split_brep_multiple_4, Gate=w2_arch_or_wall)  # -> Target0, Target1
stream_gate_4 = StreamGate(Stream=split_brep_multiple_5, Gate=w1_arch_or_wall)  # -> Target0, Target1
area_5 = Area(Geometry=stream_gate.Target1)  # -> Area, Centroid
area_6 = Area(Geometry=stream_gate_3.Target1)  # -> Area, Centroid
area_7 = Area(Geometry=stream_gate_2.Target1)  # -> Area, Centroid
area_8 = Area(Geometry=stream_gate_4.Target1)  # -> Area, Centroid
average_3 = Average(Input=area_5.Centroid)
average_4 = Average(Input=area_6.Centroid)
average_5 = Average(Input=area_7.Centroid)
average_6 = Average(Input=area_8.Centroid)
smaller_than_2 = SmallerThan(FirstNumber=average_3, SecondNumber=area_5.Centroid)  # -> SmallerThan, OrEqualTo
smaller_than_3 = SmallerThan(FirstNumber=average_5, SecondNumber=area_7.Centroid)  # -> SmallerThan, OrEqualTo
smaller_than_4 = SmallerThan(FirstNumber=average_4, SecondNumber=area_6.Centroid)  # -> SmallerThan, OrEqualTo
smaller_than_5 = SmallerThan(FirstNumber=average_6, SecondNumber=area_8.Centroid)  # -> SmallerThan, OrEqualTo
cull_pattern_4 = CullPattern(List=split_brep_multiple_2, CullPattern=[smaller_than_2.SmallerThan, stream_gate.Target0])
cull_pattern_5 = CullPattern(List=split_brep_multiple_3, CullPattern=[smaller_than_3.SmallerThan, stream_gate_2.Target0])
cull_pattern_6 = CullPattern(List=split_brep_multiple_4, CullPattern=[smaller_than_4.SmallerThan, stream_gate_3.Target0])
cull_pattern_7 = CullPattern(List=split_brep_multiple_5, CullPattern=[stream_gate_4.Target0, smaller_than_5.SmallerThan])
walls = Surface([cull_pattern_7, cull_pattern_6, cull_pattern_5, cull_pattern_4])

number_slider_9 = Slider(1000, range=0..1000)  # disabled
number_slider_10 = Slider(10000, range=0..10000)  # disabled
walls_2 = Surface(walls)
settings_custom_2 = SettingsCustom(
    StitchSeams=True,
    SimplePlanes=False,
    Refine=True,
    MinCount=number_slider_9,
    MaxCount=number_slider_10,
    AspectRatio=20,
    MaxDistance=0,
    MaxAngle=20,
    MinEdge=0,
    MaxEdge=0)  # disabled
settings_quality_2 = SettingsQuality()
mesh_brep_3 = MeshBrep(Brep=walls_2, Settings=settings_quality_2)
mesh_brep_4 = MeshBrep(Brep=simplify(flatten(walls_2)), Settings=settings_custom_2)  # disabled
colour_picker_2 = ColourPicker(PickedColour=RGB(132, 178, 255))
define_layer_2 = DefineLayer(Name="WALL", Color=colour_picker_2)
define_object_attributes_2 = DefineObjectAttributes(Layer=define_layer_2, Color=colour_picker_2)
bake_objects_2 = BakeObjects(Geometry=mesh_brep_3, Attributes=define_object_attributes_2, Bake=False)
custom_preview_2 = CustomPreview(Geometry=mesh_brep_3, Material=colour_picker_2)

number_slider_11 = Slider(1000, range=0..1000)  # disabled
number_slider_12 = Slider(10000, range=0..10000)  # disabled
transition_element_2 = Brep([transition_element_surfaces, drum_or_direct_2])
settings_quality_3 = SettingsQuality()
settings_custom_3 = SettingsCustom(
    StitchSeams=True,
    SimplePlanes=False,
    Refine=True,
    MinCount=number_slider_11,
    MaxCount=number_slider_12,
    AspectRatio=20,
    MaxDistance=0,
    MaxAngle=20,
    MinEdge=0,
    MaxEdge=0)  # disabled
mesh_brep_5 = MeshBrep(Brep=simplify(transition_element_2), Settings=settings_quality_3)
mesh_brep_6 = MeshBrep(Brep=simplify(flatten(transition_element_2)), Settings=settings_custom_3)  # disabled
colour_picker_3 = ColourPicker(PickedColour=RGB(211, 212, 156))
define_layer_3 = DefineLayer(Name="TRANSITION ELEMENTS", Color=colour_picker_3)
define_object_attributes_3 = DefineObjectAttributes(Layer=define_layer_3, Color=colour_picker_3)
bake_objects_3 = BakeObjects(Geometry=mesh_brep_5, Attributes=define_object_attributes_3, Bake=False)
custom_preview_3 = CustomPreview(Geometry=mesh_brep_5, Material=colour_picker_3)

number_slider_13 = Slider(100000, range=10000..100000)  # disabled
number_slider_14 = Slider(10000, range=0..100000)  # disabled
dome = Surface(dome_position)
settings_quality_4 = SettingsQuality()
settings_custom_4 = SettingsCustom(
    StitchSeams=True,
    SimplePlanes=False,
    Refine=True,
    MinCount=number_slider_14,
    MaxCount=number_slider_13,
    AspectRatio=20,
    MaxDistance=0,
    MaxAngle=20,
    MinEdge=0,
    MaxEdge=0)  # disabled
mesh_brep_7 = MeshBrep(Brep=dome, Settings=settings_quality_4)
mesh_brep_8 = MeshBrep(Brep=simplify(flatten(dome)), Settings=settings_custom_4)  # disabled
colour_picker_4 = ColourPicker(PickedColour=RGB(55, 15, 0))
define_layer_4 = DefineLayer(Name="DOME", Color=colour_picker_4)
define_object_attributes_4 = DefineObjectAttributes(Layer=define_layer_4, Color=colour_picker_4)
bake_objects_4 = BakeObjects(Geometry=mesh_brep_7, Attributes=define_object_attributes_4, Bake=False)
custom_preview_4 = CustomPreview(Geometry=mesh_brep_7, Material=colour_picker_4)

entwine = Entwine(Branch00=mesh_brep_7, Branch01=mesh_brep_5, Branch02=mesh_brep_3, Branch03=mesh_brep_2, FlattenInputs=True)

# ----
# All Geometris as a Tree with 4 branches
geometry = Geometry(simplify(entwine))
panel_6 = Panel(geometry)

# ----
# Exporting Classes Seperately
# We prefer exporting mesh geometries separetely,
# because it's easier to label them in CloudCompare
explode_tree = ExplodeTree(Data=geometry)  # -> Branch0, Branch1, Branch2, Branch3
concatenate_2 = Concatenate(Fragment_A=panel_4, A="_dome", Fragment_B=".obj")
concatenate_3 = Concatenate(Fragment_A=panel_4, A="_wall", Fragment_B=".obj")
concatenate_4 = Concatenate(Fragment_A=panel_4, A="_transition_elements", Fragment_B=".obj")
concatenate_5 = Concatenate(Fragment_A=panel_4, A="_arch", Fragment_B=".obj")
layernamesinorder = Panel("DOME")
layernamesinorder_2 = Panel("TRANSITION_ELEMENTS")
layernamesinorder_3 = Panel("WALL")
layernamesinorder_4 = Panel("ARCH")
obj_exporter = CSharpScript(
    geometries=simplify(explode_tree.Branch0),
    filename=concatenate_2,
    directory=file_path,
    export=export_toggle,
    layer=layernamesinorder)  # -> out; inputs geometries: tree of GeometryBase, filename: String, directory: String, export: Boolean, layer: list of String
# ---------- obj_exporter: C# usings ----------
using System.IO;
using System.Linq;
using System.Data;
using System.Drawing;
using System.Reflection;
using System.Windows.Forms;
using System.Xml;
using System.Xml.Linq;
using System.Runtime.InteropServices;

using Rhino.DocObjects;
using Rhino.Collections;
using GH_IO;
using GH_IO.Serialization;
# ---------- obj_exporter: C# ----------
    if (export)
    {
      List < Guid > guids = new List<Guid>();
      for (int i = 0; i < geometries.BranchCount; i++)
      {
        for(int n = 0; n < geometries.Branches[i].Count; n++)
        {
          var geom = geometries.Branches[i][n];

          Rhino.DocObjects.ObjectAttributes att = new Rhino.DocObjects.ObjectAttributes();

          att.Name = layer[i];
          //Set layer
          if(!string.IsNullOrEmpty(layer[i]) && Rhino.DocObjects.Layer.IsValidName(layer[i]))
          {
            //Get the current layer index
            Rhino.DocObjects.Tables.LayerTable layerTable = doc.Layers;
            //int layerIndex = layerTable.Find(layer, true);
            int layerIndex = layerTable.FindByFullPath(layer[i], true);

            if(layerIndex < 0) //This layer does not exist, we add it
            {
              //Rhino.DocObjects.Layer onlayer = new Rhino.DocObjects.Layer(); //Make a new layer
              //onlayer.Name = layer;
              //layerIndex = layerTable.Add(onlayer); //Add the layer to the layer table


              Rhino.DocObjects.Layer onlayer = EnsureFullPath(layer[i]);
              layerIndex = onlayer.LayerIndex;

              if (layerIndex > -1) //We manged to add layer!
              {
                att.LayerIndex = layerIndex;
                Print("Added new layer to the document at position " + layerIndex + " named " + layer[i] + ". ");
              } else
                Print("Layer did not add. Try cleaning up your layers."); //This never happened to me.
            }
            else
              att.LayerIndex = layerIndex; //We simply add to the existing layer
          }

          var guid = Rhino.RhinoDoc.ActiveDoc.Objects.Add(geom, att);

          guids.Add(guid);
        }
      }

      Rhino.RhinoDoc.ActiveDoc.Objects.Select(guids);
      string filepath = Path.Combine(directory, filename);
      string cmd = "_-Export " + "\"" + filepath + "\"" + " _Enter" + "P" + " _Enter" + "100" + " _Enter" + " _Enter";


      Rhino.RhinoApp.RunScript(cmd, false);

      Rhino.RhinoDoc.ActiveDoc.Objects.Delete(guids, true);
      guids.Clear();

    }
# ---------- obj_exporter: C# additional code ----------
  Rhino.DocObjects.Layer EnsureFullPath(string name) {
    Rhino.DocObjects.Layer l = FindLayerByFullPath(name);
    if (l == null) {
      string[] segments = System.Text.RegularExpressions.Regex.Split(name, "::");
      string layerPath = segments[0];
      Rhino.DocObjects.Layer CurrentLayer = EnsureLayer(layerPath, true);
      for (int i = 1; i < segments.Length; i++) {
        CurrentLayer = EnsureChildLayer(CurrentLayer, segments[i]);
      }
      l = CurrentLayer;
    }
    return l;
  }

  Rhino.DocObjects.Layer EnsureLayer(string name, bool isRoot) {
    Rhino.DocObjects.Layer l = FindLayer(name, isRoot);
    if (l == null) {
      l = new Rhino.DocObjects.Layer();
      l.Name = name;
      int id = RhinoDocument.Layers.Add(l);
      l = RhinoDocument.Layers[id];
    }
    return l;
  }

  Rhino.DocObjects.Layer FindLayerByFullPath(string name) {
    int id = RhinoDocument.Layers.FindByFullPath(name, true);
    if (id >= 0) {
      return RhinoDocument.Layers[id];
    }
    return null;
  }

  Rhino.DocObjects.Layer FindLayer(string name, bool isRoot) {
    int id = RhinoDocument.Layers.Find(name, true);
    if (id >= 0 && (!isRoot || RhinoDocument.Layers[id].ParentLayerId.Equals(Guid.Empty))) {
      return RhinoDocument.Layers[id];
    } else {
      return null;
    }
  }

  public Rhino.DocObjects.Layer FindChildLayer(Layer parent, string name) {
    if (parent.GetChildren() == null) {
      return null;
    }
    foreach (Rhino.DocObjects.Layer child in parent.GetChildren()) {
      if (child.Name.Equals(name)) {
        return child;
      }
    }
    return null;
  }

  public Rhino.DocObjects.Layer EnsureChildLayer(Layer parent, string name) {
    Rhino.DocObjects.Layer child = FindChildLayer(parent, name);
    if (child == null) {
      child = new Layer();
      child.Name = name;
      child.ParentLayerId = parent.Id;
      int id = RhinoDocument.Layers.Add(child);
      child = RhinoDocument.Layers[id];
    }
    return child;
  }


  void Bake(object obj, Rhino.DocObjects.ObjectAttributes att, int groupIndex)
  {
    if(obj == null)
      return;

    Guid id;

    //Bake to the right type of object
    if(obj is GeometryBase)
    {
      GeometryBase geomObj = obj as GeometryBase;

      switch(geomObj.ObjectType)
      {
        case Rhino.DocObjects.ObjectType.Brep:
          id = doc.Objects.AddBrep(obj as Brep, att);
          break;
        case Rhino.DocObjects.ObjectType.Curve:
          id = doc.Objects.AddCurve(obj as Curve, att);
          break;
        case Rhino.DocObjects.ObjectType.Point:
          id = doc.Objects.AddPoint((obj as Rhino.Geometry.Point).Location, att);
          break;
        case Rhino.DocObjects.ObjectType.Surface:
          id = doc.Objects.AddSurface(obj as Surface, att);
          break;
        case Rhino.DocObjects.ObjectType.Mesh:
          id = doc.Objects.AddMesh(obj as Mesh, att);
          break;
        case (Rhino.DocObjects.ObjectType) 1073741824://Rhino.DocObjects.ObjectType.Extrusion:
          id = (Guid) typeof(Rhino.DocObjects.Tables.ObjectTable).InvokeMember("AddExtrusion", BindingFlags.Instance | BindingFlags.InvokeMethod, null, doc.Objects, new object[]{obj, att});
          break;
        case Rhino.DocObjects.ObjectType.PointSet:
          id = doc.Objects.AddPointCloud(obj as Rhino.Geometry.PointCloud, att); //This is a speculative entry
          break;
        default:
          Print("The script does not know how to handle this type of geometry: " + obj.GetType().FullName);
          return;
      }
    }
    else
    {
      Type objectType = obj.GetType();

      if(objectType == typeof(Arc))
      {
        id = doc.Objects.AddArc((Arc) obj, att);
      }
      else if(objectType == typeof(Box))
      {
        id = doc.Objects.AddBrep(((Box) obj).ToBrep(), att);
      }
      else if(objectType == typeof(Circle))
      {
        id = doc.Objects.AddCircle((Circle) obj, att);
      }
      else if(objectType == typeof(Ellipse))
      {
        id = doc.Objects.AddEllipse((Ellipse) obj, att);
      }
      else if(objectType == typeof(Polyline))
      {
        id = doc.Objects.AddPolyline((Polyline) obj, att);
      }
      else if(objectType == typeof(Sphere))
      {
        id = doc.Objects.AddSphere((Sphere) obj, att);
      }
      else if(objectType == typeof(Point3d))
      {
        id = doc.Objects.AddPoint((Point3d) obj, att);
      }
      else if(objectType == typeof(Line))
      {
        id = doc.Objects.AddLine((Line) obj, att);
      }
      else if(objectType == typeof(Vector3d))
      {
        Print("Impossible to bake vectors");
        return;
      }
      else if(obj is IEnumerable)
      {
        int newGroupIndex;
        if(groupIndex == -1)
          newGroupIndex = doc.Groups.Add();
        else
          newGroupIndex = groupIndex;
        foreach(object o in obj as IEnumerable)
        {
          Bake(o, att, newGroupIndex);
        }
        return;
      }
      else
      {
        Print("Unhandled type: " + objectType.FullName);
        return;
      }
    }

    if(groupIndex != -1)
    {
      doc.Groups.AddToGroup(groupIndex, id);
      Print("Added " + obj.GetType().Name + " to group number " + groupIndex);
    }
    else
      Print("Added " + obj.GetType().Name);
  }

  static string Format(Color c)
  {
    return (new System.Text.StringBuilder("A")).Append(c.A.ToString()).Append("R").Append(c.R.ToString()).Append("G")
      .Append(c.G.ToString()).Append("B").Append(c.B.ToString()).ToString();
  }
# ---------- end obj_exporter ----------
obj_exporter_2 = CSharpScript(
    geometries=simplify(explode_tree.Branch1),
    filename=concatenate_4,
    directory=file_path,
    export=export_toggle,
    layer=layernamesinorder_2)  # -> out; inputs geometries: tree of GeometryBase, filename: String, directory: String, export: Boolean, layer: list of String; same code as obj_exporter
obj_exporter_3 = CSharpScript(
    geometries=simplify(explode_tree.Branch2),
    filename=concatenate_3,
    directory=file_path,
    export=export_toggle,
    layer=layernamesinorder_3)  # -> out; inputs geometries: tree of GeometryBase, filename: String, directory: String, export: Boolean, layer: list of String; same code as obj_exporter
obj_exporter_4 = CSharpScript(
    geometries=simplify(explode_tree.Branch3),
    filename=concatenate_5,
    directory=file_path,
    export=export_toggle,
    layer=layernamesinorder_4)  # -> out; inputs geometries: tree of GeometryBase, filename: String, directory: String, export: Boolean, layer: list of String; same code as obj_exporter

# ----
# These Warnings do not affect the
#  function but they should be replaced in case of any problem.
# They are not used anymore!
# Exporting Classes Together
layernamesinorder_5 = Panel("""DOME
TRANSITION_ELEMENTS
WALL
ARCH""")  # disabled
obj_exporter_5 = CSharpScript(geometries=simplify(geometry), filename=panel_4, directory=file_path, export=export_toggle, layer=layernamesinorder_5)  # -> out; inputs geometries: tree of GeometryBase, filename: String, directory: String, export: Boolean, layer: list of String; disabled; same code as obj_exporter
panel_7 = Panel(obj_exporter_5)  # disabled

# ==== cluster PointedArchSivriKemer
inner_distance_form_corner_ovver_the_wal = ClusterInput()  # "Inner Distance form Corner ovver the Wall"
heigth_of_the_arc = ClusterInput()
face_normals = ClusterInput()
thickness_of_the_archs = ClusterInput()
height_of_the_wall = ClusterInput()
wall_edges = ClusterInput()
wall_bottom_points = ClusterInput()
wall_upper_boundary = ClusterInput()
arch_centers_5 = ClusterInput()
arch_thickness = ClusterInput()
wall_edges_2 = Line(wall_edges)
face_normals_2 = Vector(face_normals)
heigth_of_the_arc_2 = Number(heigth_of_the_arc)
wall_bottom_points_2 = Point(wall_bottom_points)
wall_upper_boundary_2 = Curve(wall_upper_boundary)
inner_distance_form_corner_ovver_the_wal_2 = Number(inner_distance_form_corner_ovver_the_wal)  # "Inner Distance form Corner ovver the Wall"
shift_list = ShiftList(List=wall_bottom_points_2, Shift=Slider(1, range=0..1), Wrap=True)
shift_list_2 = ShiftList(List=wall_bottom_points_2, Shift=Slider(-1, range=-1..5), Wrap=True)
vector_2pt = Vector2Pt(PointA=wall_bottom_points_2, PointB=shift_list, Unitize=Toggle(True))  # -> Vector, Length
vector_2pt_2 = Vector2Pt(PointA=wall_bottom_points_2, PointB=shift_list_2, Unitize=Toggle(True))  # -> Vector, Length
multiplication = Multiplication(A=vector_2pt.Vector, B=inner_distance_form_corner_ovver_the_wal_2)
multiplication_2 = Multiplication(A=vector_2pt_2.Vector, B=inner_distance_form_corner_ovver_the_wal_2)
multiplication_3 = Multiplication(A=inner_distance_form_corner_ovver_the_wal_2, B="2")
subtraction = Subtraction(B=multiplication_3)
division = Division(A=subtraction, B="2")
move = Move(WallEdges=wall_edges_2, Motion=multiplication_2)  # -> Geometry, Transform
# Basık Sivri Kemer
move_2 = Move(WallEdges=wall_edges_2, Motion=multiplication)  # -> Geometry, Transform
unit_z = UnitZ(Factor=division)
evaluate_length = EvaluateLength(Curve=move_2.Geometry, Length=heigth_of_the_arc_2, Normalized=Slider(0, range=0..1))  # -> simplify(Point), Tangent, Parameter
evaluate_length_2 = EvaluateLength(Curve=move.Geometry, Length=heigth_of_the_arc_2, Normalized=Slider(0, range=0..1))  # -> Point, Tangent, Parameter
arch_centers_5_2 = Number(arch_centers_5)
shift_list_3 = ShiftList(List=evaluate_length_2.Point, Shift=Slider(1, range=0..10), Wrap=True)
subtraction_2 = Subtraction(A="5", B=arch_centers_5_2)
multiplication_4 = Multiplication(A=evaluate_length.Point, ArchCenter5=arch_centers_5_2)
multiplication_5 = Multiplication(A=shift_list_3, B=subtraction_2)
multiplication_6 = Multiplication(A=evaluate_length.Point, B=subtraction_2)
multiplication_7 = Multiplication(A=shift_list_3, B=arch_centers_5_2)
addition = Addition(A=multiplication_4, B=multiplication_5)
addition_2 = Addition(A=multiplication_6, B=multiplication_7)
division_2 = Division(A=addition, B="5")
division_3 = Division(A=addition_2, B="5")
multiplication_8 = Multiplication(A=inner_distance_form_corner_ovver_the_wal_2, B="2")
left_circle_centers = Point(division_2)
right_circle_centers = Point(division_3)
subtraction_3 = Subtraction(HeightOfTheWall=height_of_the_wall, B=multiplication_8)
# Arch Radius
panel = Panel("5")
left_circle_left_point = Point(simplify(flatten(evaluate_length.Point)))
right_circle_right_point = Point(shift_list_3)
division_4 = Division(A=subtraction_2, B=panel)
multiplication_9 = Multiplication(A=division_4, B=subtraction_3)
radians = Radians(Degrees=Slider(60, range=0..100))  # -> expr("x*-1", Radians)
radians_2 = Radians(Degrees=Slider(60, range=0..100))
circle_cnr = CircleCNR(Center=left_circle_centers, Normal=face_normals_2, Radius=multiplication_9)  # -> flatten(LeftCircle)
plane = Plane(circle_cnr)
rotate_3d = Rotate3D(Geometry=left_circle_left_point, Angle=radians, Center=left_circle_centers, Axis=plane)  # -> simplify(flatten(Geometry)), Transform
rotate_3d_2 = Rotate3D(Geometry=right_circle_right_point, Angle=radians_2, Center=right_circle_centers, Axis=plane)  # -> Geometry, Transform
circle_cnr_2 = CircleCNR(Center=right_circle_centers, Normal=face_normals_2, Radius=multiplication_9)  # -> flatten(RightCircle)
entwine = Entwine(Branch00=simplify(rotate_3d.Geometry), Branch01=simplify(left_circle_left_point), FlattenInputs=True)  # -> simplify(Result)
entwine_2 = Entwine(Branch00=simplify(rotate_3d_2.Geometry), Branch01=simplify(right_circle_right_point), FlattenInputs=True)  # -> simplify(Result)
curve_closest_point = CurveClosestPoint(Point=entwine, Curve=circle_cnr)  # -> Point, Parameter, Distance
curve_closest_point_2 = CurveClosestPoint(Point=entwine_2, Curve=circle_cnr_2)  # -> Point, Parameter, Distance
flip_matrix = FlipMatrix(Data=curve_closest_point.Parameter)
flip_matrix_2 = FlipMatrix(Data=curve_closest_point_2.Parameter)
shatter = Shatter(Curve=simplify(graft(circle_cnr)), Parameters=simplify(flip_matrix))
shatter_2 = Shatter(Curve=simplify(graft(circle_cnr_2)), Parameters=simplify(flip_matrix_2))
length = Length(Curve=shatter)
length_2 = Length(Curve=shatter_2)
average = Average(Input=length)
average_2 = Average(Input=length_2)
smaller_than = SmallerThan(FirstNumber=length, SecondNumber=average)  # -> SmallerThan, OrEqualTo
smaller_than_2 = SmallerThan(FirstNumber=length_2, SecondNumber=average_2)  # -> SmallerThan, OrEqualTo
cull_pattern = CullPattern(List=shatter, CullPattern=smaller_than.SmallerThan)
cull_pattern_2 = CullPattern(List=shatter_2, CullPattern=smaller_than_2.SmallerThan)
extend_curve = ExtendCurve(Curve=cull_pattern, Type=Slider(1, range=0..100), Start=Slider(500, range=0..1000), End=Slider(0, range=0..100))
extend_curve_2 = ExtendCurve(Curve=cull_pattern_2, Type=Slider(1, range=0..100), Start=Slider(0, range=0..100), End=Slider(500, range=0..1000))
curve_curve = CurveCurve(CurveA=extend_curve, CurveB=extend_curve_2)  # -> Points, ParamsA, ParamsB
curve_closest_point_3 = CurveClosestPoint(Point=curve_curve.Points, Curve=extend_curve)  # -> Point, Parameter, Distance
curve_closest_point_4 = CurveClosestPoint(Point=curve_curve.Points, Curve=extend_curve_2)  # -> Point, Parameter, Distance
shatter_3 = Shatter(Curve=extend_curve, Parameters=curve_closest_point_3.Parameter)
shatter_4 = Shatter(Curve=extend_curve_2, Parameters=curve_closest_point_4.Parameter)
center = Center(Geometry=shatter_3)  # -> Center, Dimension
center_2 = Center(Geometry=shatter_4)  # -> Center, Dimension
deconstruct = Deconstruct(Point=center.Center)  # -> XComponent, YComponent, ZComponent
deconstruct_2 = Deconstruct(Point=center_2.Center)  # -> XComponent, YComponent, ZComponent
average_3 = Average(Input=deconstruct.ZComponent)
average_4 = Average(Input=deconstruct_2.ZComponent)
larger_than = LargerThan(FirstNumber=average_3, SecondNumber=deconstruct.ZComponent)  # -> LargerThan, OrEqualTo
larger_than_2 = LargerThan(FirstNumber=average_4, SecondNumber=deconstruct_2.ZComponent)  # -> LargerThan, OrEqualTo
cull_pattern_3 = CullPattern(List=shatter_3, CullPattern=larger_than.LargerThan)
cull_pattern_4 = CullPattern(List=shatter_4, CullPattern=larger_than_2.LargerThan)
join_curves = JoinCurves(Curves=[cull_pattern_3, cull_pattern_4], Preserve=False)  # -> simplify(Curves)
points_trim_curve = PointsTrimCurve(Curve=move.Geometry, Points=evaluate_length_2.Point, Flip=False)  # -> flatten(Trimmed), SubDomains, Intersected
points_trim_curve_2 = PointsTrimCurve(Curve=move_2.Geometry, Points=evaluate_length.Point, Flip=False)  # -> flatten(Trimmed), SubDomains, Intersected
sort_curves_along_crv = SortCurvesAlongCrv(Curves=join_curves, GuideCrv=wall_upper_boundary_2, CrvParam=0.5)  # -> flatten(SortedCurves), CurveIndex
shift_list_4 = ShiftList(List=points_trim_curve.Trimmed, Shift=1, Wrap=True)
sort_curves_along_crv_2 = SortCurvesAlongCrv(Curves=points_trim_curve_2.Trimmed, GuideCrv=wall_upper_boundary_2, CrvParam=0.5)  # -> SortedCurves, CurveIndex
sort_curves_along_crv_3 = SortCurvesAlongCrv(Curves=shift_list_4, GuideCrv=wall_upper_boundary_2, CrvParam=0.5)  # -> SortedCurves, CurveIndex
curve = Curve(sort_curves_along_crv.SortedCurves)
left_hand_side_lines = Curve(sort_curves_along_crv_3.SortedCurves)
right_hand_side_lines = Curve(sort_curves_along_crv_2.SortedCurves)
arch_curved_parts = Curve(curve)
plane_2 = Plane(arch_curved_parts)
thickness_of_the_archs_2 = Number(thickness_of_the_archs)

# ----
# ARCH DEPTH
panel_2 = Panel("1")
multiplication_10 = Multiplication(A=face_normals_2, B=panel_2)
list_item = ListItem(List=[right_hand_side_lines, arch_curved_parts, left_hand_side_lines], Index=Slider(1, range=0..10), Wrap=True)
list_item_2 = ListItem(List=[right_hand_side_lines, arch_curved_parts, left_hand_side_lines], Index=Slider(2, range=0..10), Wrap=True)
list_item_3 = ListItem(List=[right_hand_side_lines, arch_curved_parts, left_hand_side_lines], Index=Slider(3, range=0..10), Wrap=True)
list_item_4 = ListItem(List=[right_hand_side_lines, arch_curved_parts, left_hand_side_lines], Index=Slider(0, range=0..10), Wrap=True)
join_curves_2 = JoinCurves(Curves=flatten(list_item_2), Preserve=False)
join_curves_3 = JoinCurves(Curves=flatten(list_item), Preserve=False)
join_curves_4 = JoinCurves(Curves=flatten(list_item_3), Preserve=False)
join_curves_5 = JoinCurves(Curves=flatten(list_item_4), Preserve=False)
list_item_5 = ListItem(List=multiplication_10, Index=Slider(0, range=0..10), Wrap=True)
list_item_6 = ListItem(List=multiplication_10, Index=Slider(1, range=0..10), Wrap=True)
list_item_7 = ListItem(List=multiplication_10, Index=Slider(3, range=0..10), Wrap=True)
list_item_8 = ListItem(List=multiplication_10, Index=Slider(2, range=0..10), Wrap=True)
multiplication_11 = Multiplication(A=list_item_5, B=thickness_of_the_archs_2)
multiplication_12 = Multiplication(A=list_item_6, B=thickness_of_the_archs_2)
multiplication_13 = Multiplication(A=list_item_8, B=thickness_of_the_archs_2)
multiplication_14 = Multiplication(A=list_item_7, B=thickness_of_the_archs_2)
move_3 = Move(Geometry=join_curves_5, Motion=multiplication_11)  # -> flatten(Geometry), Transform
move_4 = Move(Geometry=join_curves_3, Motion=multiplication_12)  # -> flatten(Geometry), Transform
move_5 = Move(Geometry=join_curves_2, Motion=multiplication_13)  # -> flatten(Geometry), Transform
move_6 = Move(Geometry=join_curves_4, Motion=multiplication_14)  # -> flatten(Geometry), Transform
north_arch = Loft(
    Curves=flatten([join_curves_5, move_3.Geometry]),
    Options={Adjust=False, Closed=False, LoftEnds=0, LoftSimp=0, LoftType=0, Rebuild=10, Refit=0.01})
west_arch = Loft(
    Curves=flatten([join_curves_3, move_4.Geometry]),
    Options={Adjust=False, Closed=False, LoftEnds=0, LoftSimp=0, LoftType=0, Rebuild=10, Refit=0.01})
south_arch = Loft(
    Curves=flatten([join_curves_2, move_5.Geometry]),
    Options={Adjust=False, Closed=False, LoftEnds=0, LoftSimp=0, LoftType=0, Rebuild=10, Refit=0.01})
east_arch = Loft(
    Curves=flatten([join_curves_4, move_6.Geometry]),
    Options={Adjust=False, Closed=False, LoftEnds=0, LoftSimp=0, LoftType=0, Rebuild=10, Refit=0.01})

arch_thickness_2 = Number(arch_thickness)

# ---- group: Arch Interior Offset
curve_south = Curve(join_curves_2)
curve_east = Curve(join_curves_4)
curve_north = Curve(join_curves_5)
curve_west = Curve(join_curves_3)
list_item_9 = ListItem(List=plane_2, Index=Slider(1, range=0..10), Wrap=True)
list_item_10 = ListItem(List=plane_2, Index=Slider(0, range=0..10), Wrap=True)
list_item_11 = ListItem(List=plane_2, Index=Slider(2, range=0..10), Wrap=True)
list_item_12 = ListItem(List=plane_2, Index=Slider(3, range=0..10), Wrap=True)
offset_curve = OffsetCurve(Curve=curve_west, Distance=arch_thickness_2, Plane=list_item_9, Corners=1)
offset_curve_2 = OffsetCurve(Curve=curve_north, Distance=arch_thickness_2, Plane=list_item_10, Corners=1)
offset_curve_3 = OffsetCurve(Curve=curve_south, Distance=arch_thickness_2, Plane=list_item_11, Corners=1)
offset_curve_4 = OffsetCurve(Curve=curve_east, Distance=arch_thickness_2, Plane=list_item_12, Corners=1)
north_arch_2 = Loft(
    Curves=flatten([curve_north, offset_curve_2]),
    Options={Adjust=False, Closed=False, LoftEnds=0, LoftSimp=0, LoftType=0, Rebuild=10, Refit=0.01})
west_arch_2 = Loft(
    Curves=flatten([offset_curve, curve_west]),
    Options={Adjust=False, Closed=False, LoftEnds=0, LoftSimp=0, LoftType=0, Rebuild=10, Refit=0.01})
south_arch_2 = Loft(
    Curves=flatten([curve_south, offset_curve_3]),
    Options={Adjust=False, Closed=False, LoftEnds=0, LoftSimp=0, LoftType=0, Rebuild=10, Refit=0.01})
east_arch_2 = Loft(
    Curves=flatten([offset_curve_4, curve_east]),
    Options={Adjust=False, Closed=False, LoftEnds=0, LoftSimp=0, LoftType=0, Rebuild=10, Refit=0.01})

# ---- group: Arch Exterior Offset
curve_north_2 = Curve(move_3.Geometry)
curve_west_2 = Curve(move_4.Geometry)
curve_south_2 = Curve(move_5.Geometry)
curve_east_2 = Curve(move_6.Geometry)
list_item_13 = ListItem(List=plane_2, Index=Slider(0, range=0..10), Wrap=True)
list_item_14 = ListItem(List=plane_2, Index=Slider(1, range=0..10), Wrap=True)
list_item_15 = ListItem(List=plane_2, Index=Slider(2, range=0..10), Wrap=True)
list_item_16 = ListItem(List=plane_2, Index=Slider(3, range=0..10), Wrap=True)
offset_curve_5 = OffsetCurve(Curve=curve_north_2, Distance=arch_thickness_2, Plane=list_item_13, Corners=1)
offset_curve_6 = OffsetCurve(Curve=curve_west_2, Distance=arch_thickness_2, Plane=list_item_14, Corners=1)
offset_curve_7 = OffsetCurve(Curve=curve_south_2, Distance=arch_thickness_2, Plane=list_item_15, Corners=1)
offset_curve_8 = OffsetCurve(Curve=curve_east_2, Distance=arch_thickness_2, Plane=list_item_16, Corners=1)
west_arch_3 = Loft(
    Curves=flatten([offset_curve_6, curve_west_2]),
    Options={Adjust=False, Closed=False, LoftEnds=0, LoftSimp=0, LoftType=0, Rebuild=10, Refit=0.01})
north_arch_3 = Loft(
    Curves=flatten([curve_north_2, offset_curve_5]),
    Options={Adjust=False, Closed=False, LoftEnds=0, LoftSimp=0, LoftType=0, Rebuild=10, Refit=0.01})
south_arch_3 = Loft(
    Curves=flatten([curve_south_2, offset_curve_7]),
    Options={Adjust=False, Closed=False, LoftEnds=0, LoftSimp=0, LoftType=0, Rebuild=10, Refit=0.01})
east_arch_3 = Loft(
    Curves=flatten([offset_curve_8, curve_east_2]),
    Options={Adjust=False, Closed=False, LoftEnds=0, LoftSimp=0, LoftType=0, Rebuild=10, Refit=0.01})

# ---- group: Output Breps
south_arch_surface = BrepJoin(Breps=[south_arch_3, south_arch_2, south_arch])  # -> Breps, Closed
north_arch_surface = BrepJoin(Breps=[north_arch_3, north_arch_2, north_arch])  # -> Breps, Closed
west_arch_surface = BrepJoin(Breps=[west_arch_3, west_arch_2, west_arch])  # -> Breps, Closed
east_arch_surface = BrepJoin(Breps=[east_arch_3, east_arch_2, east_arch])  # -> Breps, Closed

# ----
breps = ClusterOutput(south_arch_surface.Breps)
breps_2 = ClusterOutput(north_arch_surface.Breps)
breps_3 = ClusterOutput(west_arch_surface.Breps)
breps_4 = ClusterOutput(east_arch_surface.Breps)

# ==== cluster CornerTriangle
wall_edges = ClusterInput()
bottom_drum_polygon = ClusterInput()
wall_edges_2 = Curve(wall_edges)
wall_length = ClusterInput()

# ----
# CREATION OF TRIANGLE
#  AT THE CORNER
explode = Explode(BottomDrumPolygon=bottom_drum_polygon, Recursive=True)  # -> Segments, Vertices
list_item = ListItem(List=explode.Segments, Index=Slider(0, range=0..100), Wrap=True)
length = Length(Curve=list_item)
subtraction = Subtraction(WallLength=wall_length, B=length)
end_points = EndPoints(Curve=explode.Segments)  # -> Start, End
division = Division(A=subtraction, B=Slider(2, range=0..10))
list_item_2 = ListItem(WallEdges=wall_edges_2, Index=Slider(0, range=0..100), Wrap=True)
length_2 = Length(Curve=list_item_2)
subtraction_2 = Subtraction(A=length_2, B=division)
panel = Panel("""True
False""")
cull_pattern = CullPattern(List=end_points.Start, CullPattern=panel)
panel_2 = Panel("""True
False""")
point = Point(end_points.End)
evaluate_length = EvaluateLength(WallEdges=wall_edges_2, Length=subtraction_2, Normalized=Slider(0, range=0..1))  # -> Point, Tangent, Parameter
shift_list = ShiftList(List=cull_pattern, Shift=Slider(3, range=0..10), Wrap=True)
cull_pattern_2 = CullPattern(List=point, CullPattern=panel_2)
shift_list_2 = ShiftList(List=cull_pattern_2, Shift=Slider(2, range=0..10), Wrap=True)
line = Line(StartPoint=evaluate_length.Point, EndPoint=shift_list)  # -> simplify(graft(Line))
line_2 = Line(StartPoint=evaluate_length.Point, EndPoint=shift_list_2)  # -> graft(Line)
line_3 = Line(StartPoint=shift_list, EndPoint=shift_list_2)  # -> graft(Line)
loft = Loft(
    Curves=[line_2, line_3],
    Options={Adjust=False, Closed=False, LoftEnds=0, LoftSimp=0, LoftType=0, Rebuild=10, Refit=0.01})  # -> simplify(Loft)

loft_2 = ClusterOutput(loft)

# ==== cluster SemicirclarArchYarımDaire
wall_edges = ClusterInput()
depth_from_the_corner = ClusterInput()
wall_bottom_corners = ClusterInput()
height_of_the_arc = ClusterInput()
arch_thickness = ClusterInput()
wall_length = ClusterInput()
wall_edges_2 = Line(wall_edges)
wall_bottom_corners_2 = Point(wall_bottom_corners)
height_of_the_arc_2 = Number(height_of_the_arc)
depth_from_the_corner_2 = Number(depth_from_the_corner)

# ----
# ARCH CREATION
number_slider = Slider(1, range=0..1)
shift_list = ShiftList(List=wall_bottom_corners_2, Shift=number_slider, Wrap=True)
shift_list_2 = ShiftList(List=wall_bottom_corners_2, Shift=Slider(-1, range=-1..5), Wrap=True)
vector_2pt = Vector2Pt(PointA=wall_bottom_corners_2, PointB=shift_list, Unitize=Toggle(True))  # -> Vector, Length
vector_2pt_2 = Vector2Pt(PointA=wall_bottom_corners_2, PointB=shift_list_2, Unitize=Toggle(True))  # -> Vector, Length
multiplication = Multiplication(A=vector_2pt.Vector, B=depth_from_the_corner_2)
multiplication_2 = Multiplication(A=depth_from_the_corner_2, B="2")
multiplication_3 = Multiplication(A=vector_2pt_2.Vector, B=depth_from_the_corner_2)
subtraction = Subtraction(WallLength=wall_length, B=multiplication_2)
division = Division(A=subtraction, B="2")
move = Move(Geometry=wall_edges_2, Motion=multiplication_3)  # -> Geometry, Transform
move_2 = Move(Geometry=wall_edges_2, Motion=multiplication)  # -> Geometry, Transform
unit_z = UnitZ(Factor=division)
evaluate_length = EvaluateLength(Curve=move_2.Geometry, Length=height_of_the_arc_2, Normalized=Slider(0, range=0..1))  # -> Point, Tangent, Parameter
evaluate_length_2 = EvaluateLength(Curve=move.Geometry, Length=height_of_the_arc_2, Normalized=Slider(0, range=0..1))  # -> Point, Tangent, Parameter
shift_list_3 = ShiftList(List=evaluate_length_2.Point, Shift=Slider(1, range=0..10), Wrap=True)
addition = Addition(A=shift_list_3, B=evaluate_length.Point)
division_2 = Division(A=addition, B="2")
point = Point(division_2)
move_3 = Move(Geometry=point, Motion=unit_z)  # -> Geometry, Transform
arc_3pt = Arc3Pt(PointA=evaluate_length.Point, PointB=move_3.Geometry, PointC=shift_list_3)  # -> Arc, Plane, Radius

arch_thickness_2 = Number(arch_thickness)
points_trim_curve = PointsTrimCurve(Curve=move.Geometry, Points=evaluate_length_2.Point, Flip=False)  # -> flatten(Trimmed), SubDomains, Intersected
points_trim_curve_2 = PointsTrimCurve(Curve=move_2.Geometry, Points=evaluate_length.Point, Flip=False)  # -> flatten(Trimmed), SubDomains, Intersected
divide_curve = DivideCurve(Curve=arc_3pt.Arc, Count=Slider(3, range=0..10), Kinks=False)  # -> Points, Tangents, Parameters
shatter = Shatter(Curve=graft(arc_3pt.Arc), Parameters=divide_curve.Parameters)  # -> simplify(Segments)
list_item = ListItem(List=shatter, Index=Slider(2, range=0..2), Wrap=True)
list_item_2 = ListItem(List=shatter, Index=Slider(0, range=0..2), Wrap=True)
extend_curve = ExtendCurve(Curve=list_item, Type=Slider(0, range=0..100), Start=Slider(500, range=0..500), End=Slider(0, range=0..100))
extend_curve_2 = ExtendCurve(Curve=list_item_2, Type=Slider(0, range=0..100), Start=Slider(0, range=0..100), End=Slider(500, range=0..500))
curve_curve = CurveCurve(CurveA=extend_curve, CurveB=extend_curve_2)  # -> Points, ParamsA, ParamsB
curve_closest_point = CurveClosestPoint(Point=curve_curve.Points, Curve=extend_curve)  # -> Point, Parameter, Distance
curve_closest_point_2 = CurveClosestPoint(Point=curve_curve.Points, Curve=extend_curve_2)  # -> Point, Parameter, Distance
shatter_2 = Shatter(Curve=extend_curve, Parameters=curve_closest_point.Parameter)  # -> simplify(Segments)
shatter_3 = Shatter(Curve=extend_curve_2, Parameters=curve_closest_point_2.Parameter)  # -> simplify(Segments)
center = Center(Geometry=shatter_2)  # -> Center, Dimension
center_2 = Center(Geometry=shatter_3)  # -> Center, Dimension
deconstruct = Deconstruct(Point=center.Center)  # -> XComponent, YComponent, ZComponent
deconstruct_2 = Deconstruct(Point=center_2.Center)  # -> XComponent, YComponent, ZComponent
average = Average(Input=deconstruct.ZComponent)
average_2 = Average(Input=deconstruct_2.ZComponent)
smaller_than = SmallerThan(FirstNumber=deconstruct.ZComponent, SecondNumber=average)  # -> SmallerThan, OrEqualTo
smaller_than_2 = SmallerThan(FirstNumber=deconstruct_2.ZComponent, SecondNumber=average_2)  # -> SmallerThan, OrEqualTo
cull_pattern = CullPattern(List=simplify(shatter_2), CullPattern=simplify(smaller_than.SmallerThan))
cull_pattern_2 = CullPattern(List=simplify(shatter_3), CullPattern=simplify(smaller_than_2.SmallerThan))
join_curves = JoinCurves(Curves=[cull_pattern, cull_pattern_2], Preserve=False)  # -> simplify(CurvedPartOfTheArchs)
arch_left_line = Curve(points_trim_curve_2.Trimmed)
plane = Plane(arc_3pt.Plane)
depth_of_the_ach = ClusterInput()

# ----
# ARCH DEPTH
number_slider_2 = Slider(1, range=0..10)
shift_list_4 = ShiftList(List=points_trim_curve.Trimmed, Shift=number_slider_2, Wrap=True)
deconstruct_plane = DeconstructPlane(Plane=arc_3pt.Arc)  # -> Origin, XAxis, YAxis, ZAxis
multiplication_4 = Multiplication(A=deconstruct_plane.ZAxis, B="-1")
list_item_3 = ListItem(List=multiplication_4, Index=Slider(0, range=0..10), Wrap=True)
list_item_4 = ListItem(List=multiplication_4, Index=Slider(1, range=0..10), Wrap=True)
list_item_5 = ListItem(List=multiplication_4, Index=Slider(3, range=0..10), Wrap=True)
list_item_6 = ListItem(List=multiplication_4, Index=Slider(2, range=0..10), Wrap=True)
multiplication_5 = Multiplication(A=list_item_3, B=depth_of_the_ach)
multiplication_6 = Multiplication(A=list_item_4, B=depth_of_the_ach)
multiplication_7 = Multiplication(A=list_item_6, B=depth_of_the_ach)
multiplication_8 = Multiplication(A=list_item_5, B=depth_of_the_ach)

arch_right_line = Curve(shift_list_4)
entwine = Entwine(Branch00=arch_left_line, Branch01=flatten(join_curves), Branch02=arch_right_line, FlattenInputs=True)

list_item_7 = ListItem(List=entwine, Index=Slider(1, range=0..10), Wrap=True)
list_item_8 = ListItem(List=entwine, Index=Slider(3, range=0..10), Wrap=True)
list_item_9 = ListItem(List=entwine, Index=Slider(2, range=0..10), Wrap=True)
list_item_10 = ListItem(List=entwine, Index=Slider(0, range=0..10), Wrap=True)
join_curves_2 = JoinCurves(Curves=flatten(list_item_10), Preserve=False)
join_curves_3 = JoinCurves(Curves=flatten(list_item_7), Preserve=False)
join_curves_4 = JoinCurves(Curves=flatten(list_item_9), Preserve=False)
join_curves_5 = JoinCurves(Curves=flatten(list_item_8), Preserve=False)
move_4 = Move(Geometry=join_curves_2, Motion=multiplication_5)  # -> flatten(Geometry), Transform
move_5 = Move(Geometry=join_curves_3, Motion=multiplication_6)  # -> flatten(Geometry), Transform
move_6 = Move(Geometry=join_curves_4, Motion=multiplication_7)  # -> flatten(Geometry), Transform
move_7 = Move(Geometry=join_curves_5, Motion=multiplication_8)  # -> flatten(Geometry), Transform
west_arch = Loft(
    Curves=flatten([join_curves_3, move_5.Geometry]),
    Options={Adjust=False, Closed=False, LoftEnds=0, LoftSimp=0, LoftType=0, Rebuild=10, Refit=0.01})
south_arch = Loft(
    Curves=flatten([join_curves_4, move_6.Geometry]),
    Options={Adjust=False, Closed=False, LoftEnds=0, LoftSimp=0, LoftType=0, Rebuild=10, Refit=0.01})
east_arch = Loft(
    Curves=flatten([join_curves_5, move_7.Geometry]),
    Options={Adjust=False, Closed=False, LoftEnds=0, LoftSimp=0, LoftType=0, Rebuild=10, Refit=0.01})
north_arch = Loft(
    Curves=flatten([join_curves_2, move_4.Geometry]),
    Options={Adjust=False, Closed=False, LoftEnds=0, LoftSimp=0, LoftType=0, Rebuild=10, Refit=0.01})

# ---- group: Arch Interior Offset
curve_south = Curve(join_curves_4)
curve_east = Curve(join_curves_5)
curve_north = Curve(join_curves_2)
curve_west = Curve(join_curves_3)
list_item_11 = ListItem(List=plane, Index=Slider(1, range=0..10), Wrap=True)
list_item_12 = ListItem(List=plane, Index=Slider(0, range=0..10), Wrap=True)
list_item_13 = ListItem(List=plane, Index=Slider(2, range=0..10), Wrap=True)
list_item_14 = ListItem(List=plane, Index=Slider(3, range=0..10), Wrap=True)
offset_curve = OffsetCurve(Curve=curve_north, Distance=arch_thickness_2, Plane=list_item_12, Corners=1)
offset_curve_2 = OffsetCurve(Curve=curve_west, Distance=arch_thickness_2, Plane=list_item_11, Corners=1)
offset_curve_3 = OffsetCurve(Curve=curve_south, Distance=arch_thickness_2, Plane=list_item_13, Corners=1)
offset_curve_4 = OffsetCurve(Curve=curve_east, Distance=arch_thickness_2, Plane=list_item_14, Corners=1)
north_arch_2 = Loft(
    Curves=flatten([curve_north, offset_curve]),
    Options={Adjust=False, Closed=False, LoftEnds=0, LoftSimp=0, LoftType=0, Rebuild=10, Refit=0.01})
west_arch_2 = Loft(
    Curves=flatten([offset_curve_2, curve_west]),
    Options={Adjust=False, Closed=False, LoftEnds=0, LoftSimp=0, LoftType=0, Rebuild=10, Refit=0.01})
south_arch_2 = Loft(
    Curves=flatten([curve_south, offset_curve_3]),
    Options={Adjust=False, Closed=False, LoftEnds=0, LoftSimp=0, LoftType=0, Rebuild=10, Refit=0.01})
east_arch_2 = Loft(
    Curves=flatten([offset_curve_4, curve_east]),
    Options={Adjust=False, Closed=False, LoftEnds=0, LoftSimp=0, LoftType=0, Rebuild=10, Refit=0.01})

# ---- group: Arch Exterior Offset
curve_north_2 = Curve(move_4.Geometry)
curve_west_2 = Curve(move_5.Geometry)
curve_south_2 = Curve(move_6.Geometry)
curve_east_2 = Curve(move_7.Geometry)
list_item_15 = ListItem(List=plane, Index=Slider(0, range=0..10), Wrap=True)
list_item_16 = ListItem(List=plane, Index=Slider(1, range=0..10), Wrap=True)
list_item_17 = ListItem(List=plane, Index=Slider(2, range=0..10), Wrap=True)
list_item_18 = ListItem(List=plane, Index=Slider(3, range=0..10), Wrap=True)
offset_curve_5 = OffsetCurve(Curve=curve_north_2, Distance=arch_thickness_2, Plane=list_item_15, Corners=1)
offset_curve_6 = OffsetCurve(Curve=curve_west_2, Distance=arch_thickness_2, Plane=list_item_16, Corners=1)
offset_curve_7 = OffsetCurve(Curve=curve_south_2, Distance=arch_thickness_2, Plane=list_item_17, Corners=1)
offset_curve_8 = OffsetCurve(Curve=curve_east_2, Distance=arch_thickness_2, Plane=list_item_18, Corners=1)
west_arch_3 = Loft(
    Curves=flatten([offset_curve_6, curve_west_2]),
    Options={Adjust=False, Closed=False, LoftEnds=0, LoftSimp=0, LoftType=0, Rebuild=10, Refit=0.01})
north_arch_3 = Loft(
    Curves=flatten([curve_north_2, offset_curve_5]),
    Options={Adjust=False, Closed=False, LoftEnds=0, LoftSimp=0, LoftType=0, Rebuild=10, Refit=0.01})
south_arch_3 = Loft(
    Curves=flatten([curve_south_2, offset_curve_7]),
    Options={Adjust=False, Closed=False, LoftEnds=0, LoftSimp=0, LoftType=0, Rebuild=10, Refit=0.01})
east_arch_3 = Loft(
    Curves=flatten([offset_curve_8, curve_east_2]),
    Options={Adjust=False, Closed=False, LoftEnds=0, LoftSimp=0, LoftType=0, Rebuild=10, Refit=0.01})

# ---- group: Output Breps
south_arch_surface = BrepJoin(Breps=[south_arch_3, south_arch_2, south_arch])  # -> Breps, Closed
north_arch_surface = BrepJoin(Breps=[north_arch, north_arch_2, north_arch_3])  # -> Breps, Closed
west_arch_surface = BrepJoin(Breps=[west_arch_3, west_arch_2, west_arch])  # -> Breps, Closed
east_arch_surface = BrepJoin(Breps=[east_arch_3, east_arch_2, east_arch])  # -> Breps, Closed

# ----
breps = ClusterOutput(south_arch_surface.Breps)
breps_2 = ClusterOutput(north_arch_surface.Breps)
breps_3 = ClusterOutput(west_arch_surface.Breps)
breps_4 = ClusterOutput(east_arch_surface.Breps)

# ==== cluster Pendentive
x = ClusterInput()
wall_top_rectangle = ClusterInput()
expression = Expression(x=x, Expression="(x/8)*3")
shift_list = ShiftList(WallTopRectangle=wall_top_rectangle, Shift=expression, Wrap=True)
wall_length = ClusterInput()
cull_duplicates = CullDuplicates(Points=shift_list, Tolerance=0.1, CullMode=3)  # -> Points, Indices, Valence
division = Division(WallLength=wall_length, B=Slider(2, range=0..10))
drum_bottom_circle = ClusterInput()
drum_bottom_polygon = ClusterInput()
unit_z = UnitZ(Factor=division)  # -> expr("x*-1", UnitVector)
curve_curve = CurveCurve(DrumBottomCircle=drum_bottom_circle, DrumBottomPolygon=drum_bottom_polygon)  # -> simplify(Points), ParamsA, ParamsB
move = Move(Geometry=cull_duplicates.Points, Motion=unit_z)  # -> simplify(Geometry), Transform
shift_list_2 = ShiftList(List=curve_curve.Points, Shift=1, Wrap=True)  # -> simplify(List)
entwine = Entwine(Branch00=curve_curve.Points, Branch01=shift_list_2, FlattenInputs=True)
entwine_2 = Entwine(Branch00=move.Geometry, Branch01=entwine, FlattenInputs=True)  # -> simplify(flatten(Result))
wall_top_triangle_sort_reference = ClusterInput()
list_item = ListItem(List=entwine, Index=Slider(0, range=0..20), Wrap=True)
sort_along_curve = SortAlongCurve(Points=entwine_2, WallTopTriangleSortReference=wall_top_triangle_sort_reference)  # -> Points, Indices
param_viewer = ParamViewer(entwine_2)
cull_duplicates_2 = CullDuplicates(Points=sort_along_curve.Points, Tolerance=0.1, CullMode=3)  # -> Points, Indices, Valence
flip_matrix = FlipMatrix(Data=cull_duplicates_2.Points)
list_item_2 = ListItem(List=flatten(flip_matrix), Index=Slider(2, range=0..16), Wrap=True)
list_item_3 = ListItem(List=flatten(flip_matrix), Index=Slider(1, range=0..16), Wrap=True)
list_item_4 = ListItem(List=flatten(flip_matrix), Index=Slider(3, range=0..16), Wrap=True)
list_item_5 = ListItem(List=flatten(flip_matrix), Index=Slider(2, range=0..16), Wrap=True)
list_item_6 = ListItem(List=flatten(flip_matrix), Index=Slider(0, range=0..16), Wrap=True)
list_item_7 = ListItem(List=flatten(flip_matrix), Index=Slider(5, range=0..16), Wrap=True)
list_item_8 = ListItem(List=flatten(flip_matrix), Index=Slider(6, range=0..16), Wrap=True)
list_item_9 = ListItem(List=flatten(flip_matrix), Index=Slider(1, range=0..16), Wrap=True)
list_item_10 = ListItem(List=flatten(flip_matrix), Index=Slider(6, range=0..16), Wrap=True)
list_item_11 = ListItem(List=flatten(flip_matrix), Index=Slider(7, range=0..16), Wrap=True)
list_item_12 = ListItem(List=flatten(flip_matrix), Index=Slider(3, range=0..16), Wrap=True)
list_item_13 = ListItem(List=flatten(flip_matrix), Index=Slider(4, range=0..16), Wrap=True)
list_item_14 = ListItem(List=flatten(flip_matrix), Index=Slider(4, range=0..16), Wrap=True)
list_item_15 = ListItem(List=flatten(flip_matrix), Index=Slider(5, range=0..16), Wrap=True)
list_item_16 = ListItem(List=flatten(flip_matrix), Index=Slider(7, range=0..16), Wrap=True)
list_item_17 = ListItem(List=flatten(flip_matrix), Index=Slider(0, range=0..16), Wrap=True)
point = Point([list_item_6, list_item_9])
point_2 = Point([list_item_3, list_item_5])
point_3 = Point([list_item_2, list_item_4])
point_4 = Point([list_item_12, list_item_14])
point_5 = Point([list_item_13, list_item_15])
point_6 = Point([list_item_8, list_item_11])
point_7 = Point([list_item_7, list_item_10])
point_8 = Point([list_item_16, list_item_17])
number_slider = Slider(1, range=-10..10)
x_axis = ClusterInput()
y_axis = ClusterInput()
entwine_3 = Entwine(Branch0X=point, Branch1X=point_2, FlattenInputs=False)
entwine_4 = Entwine(Branch0X=point_3, Branch1X=point_4, FlattenInputs=False)
x_axis_2 = Vector(x_axis)
y_axis_2 = Vector(y_axis)
entwine_5 = Entwine(Branch0X=point_5, Branch1X=point_7, FlattenInputs=False)
entwine_6 = Entwine(Branch0X=point_6, Branch1X=point_8, FlattenInputs=False)
shift_list_3 = ShiftList(List=x_axis_2, Shift=number_slider, Wrap=True)
shift_list_4 = ShiftList(List=y_axis_2, Shift=number_slider, Wrap=True)
entwine_7 = Entwine(Branch0X=entwine_3, Branch1X=entwine_4, Branch2X=entwine_5, Branch3X=entwine_6, FlattenInputs=False)  # -> simplify(Result)
construct_plane = ConstructPlane(Origin=move.Geometry, XAxis=shift_list_3, YAxis=shift_list_4)
construct_plane_2 = ConstructPlane(Origin=move.Geometry, XAxis=x_axis_2, YAxis=y_axis_2)
wall_normals = ClusterInput()
circle = Circle(Plane=construct_plane, Radius=division)  # -> simplify(Circle)
circle_2 = Circle(Plane=construct_plane_2, Radius=division)  # -> simplify(Circle)
wall_normals_2 = Vector(wall_normals)
shift_list_5 = ShiftList(List=circle, Shift=1, Wrap=True)
curve_curve_2 = CurveCurve(CurveA=circle_2, CurveB=shift_list_5)  # -> simplify(Points), ParamsA, ParamsB
shift_list_6 = ShiftList(WallNormals=wall_normals_2, Shift=Slider(0, range=0..1), Wrap=True)
stack_trees = StackTrees(Data0=wall_normals_2, Data1=shift_list_6, Reduce=True)
flip_matrix_2 = FlipMatrix(Data=stack_trees)
flip_matrix_3 = FlipMatrix(Data=curve_curve_2.Points)
list_item_18 = ListItem(List=flip_matrix_3, Index=Slider(0, range=0..10), Wrap=True)
list_item_19 = ListItem(List=flip_matrix_2, Index=Slider(0, range=0..10), Wrap=True)
plane_normal = PlaneNormal(Origin=curve_curve_2.Points, ZAxis=flip_matrix_2)
circle_3 = Circle(Plane=plane_normal, Radius=division)  # -> simplify(graft(Circle))
param_viewer_2 = ParamViewer(circle_3)
param_viewer_3 = ParamViewer(entwine_7)
curve_closest_point = CurveClosestPoint(Point=simplify(entwine_7), Curve=circle_3)  # -> Point, Parameter, Distance
shatter = Shatter(Curve=circle_3, Parameters=curve_closest_point.Parameter)  # -> simplify(Segments)
length = Length(Curve=shatter)
average = Average(Input=length)
panel = Panel(length)
smaller_than = SmallerThan(FirstNumber=length, SecondNumber=average)  # -> SmallerThan, OrEqualTo
bottom_drum_circle = ClusterInput()
cull_pattern = CullPattern(List=shatter, CullPattern=smaller_than.SmallerThan)
guidecrv_bottom_drum_circle = ClusterInput()
bottom_drum_circle_2 = Circle(bottom_drum_circle)
trim_tree = TrimTree(Tree=cull_pattern, Depth=1)  # -> flatten(Tree)
curve_closest_point_2 = CurveClosestPoint(Point=simplify(curve_curve.Points), Curve=bottom_drum_circle_2)  # -> Point, Parameter, Distance
sort_curves_along_crv = SortCurvesAlongCrv(Curves=trim_tree, GuideCrvBottomDrumCircle=guidecrv_bottom_drum_circle, CrvParam=0.5)  # -> SortedCurves, CurveIndex
curve = Curve(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)
shatter_2 = Shatter(Curve=bottom_drum_circle_2, Parameters=curve_closest_point_2.Parameter)
flip_curve = FlipCurve(Curve=sort_curves_along_crv.SortedCurves, Guide=curve)  # -> Curve, Flag
divide_list = DivideList(List=flip_curve.Curve, Number=Slider(4, range=0..10))  # -> Chunk, Remainder
flip_matrix_4 = FlipMatrix(Data=divide_list.Chunk)
curve_2 = Curve(shatter_2)
number_slider_2 = Slider(2, range=0..100)
number_slider_3 = Slider(3, range=0..100)
number_slider_4 = Slider(0, range=0..100)
number_slider_5 = Slider(1, range=0..100)
# THINK ABOUT
# DATA STRUCTURES
# WHEN POSSIBLE
list_item_20 = ListItem(List=flip_matrix_4, Index=number_slider_4, Wrap=True)
list_item_21 = ListItem(List=curve_2, Index=number_slider_4, Wrap=True)
list_item_22 = ListItem(List=flip_matrix_4, Index=number_slider_5, Wrap=True)
list_item_23 = ListItem(List=flip_matrix_4, Index=number_slider_2, Wrap=True)
list_item_24 = ListItem(List=curve_2, Index=number_slider_2, Wrap=True)
list_item_25 = ListItem(List=curve_2, Index=number_slider_5, Wrap=True)
list_item_26 = ListItem(List=flip_matrix_4, Index=number_slider_3, Wrap=True)
list_item_27 = ListItem(List=curve_2, Index=number_slider_3, Wrap=True)
patch = Patch(Curves=flatten([list_item_23, list_item_24]), Spans=20, Flexibility=1, Trim=True)
patch_2 = Patch(Curves=flatten([list_item_22, list_item_25]), Spans=20, Flexibility=1, Trim=True)
patch_3 = Patch(Curves=flatten([list_item_27, list_item_26]), Spans=20, Flexibility=1, Trim=True)
patch_4 = Patch(Curves=flatten([list_item_20, list_item_21]), Spans=20, Flexibility=1, Trim=True)
brep = Brep([patch_4, patch_3, patch, patch_2])
brep_2 = ClusterOutput(brep)

# ==== cluster TurkishTriangle
polygon_edge_number = ClusterInput()
drum_top_polygon = ClusterInput()
wall_top_rectangle_verices = ClusterInput()
number_slider = Slider(0, range=0..20)
drum_height_vector = ClusterInput()

# ----
# CREATION OF Turkish corner TRIANGLE group BAND
polygon_edge_number_2 = Number(polygon_edge_number)
explode = Explode(DrumTopPolygon=drum_top_polygon, Recursive=True)  # -> Segments, Vertices
list_length = ListLength(List=explode.Vertices)
expression = Expression(x=list_length, Expression="X-1")
split_list = SplitList(List=explode.Vertices, Index=expression)  # -> ListA, ListB
list_item = ListItem(List=split_list.ListA, Index=number_slider, Wrap=True)
loft_options = LoftOptions(Closed=Toggle(True), Adjust=False, Rebuild=0, Refit=0, Type=Slider(3, range=0..10))

expression_2 = Expression(x=polygon_edge_number_2, Expression="(x/8)*3")
expression_3 = Expression(x=polygon_edge_number_2, Expression="if((x=8),3,if((x=16),13,if((x=32),1,if((x=48),14,0))) )")
shift_list = ShiftList(List=split_list.ListA, Shift=expression_3, Wrap=True)
divide_list = DivideList(List=shift_list, Number=Slider(4, range=0..10))  # -> Chunk, Remainder
flip_matrix = FlipMatrix(Data=divide_list.Chunk)
list_item_2 = ListItem(List=flip_matrix, Index=Slider(0, range=0..20), Wrap=True)

shift_list_2 = ShiftList(WallTopRectangleVerices=wall_top_rectangle_verices, Shift=expression_2, Wrap=True)
list_item_3 = ListItem(List=shift_list_2, Index=number_slider, Wrap=True)

cull_duplicates = CullDuplicates(Points=shift_list_2, Tolerance=0.1, CullMode=3)  # -> Points, Indices, Valence
line = Line(StartPoint=cull_duplicates.Points, EndPoint=flip_matrix)
flip_matrix_2 = FlipMatrix(Data=line)  # -> flatten(Data)
list_item_4 = ListItem(List=flip_matrix_2, Index=Slider(32, range=0..32), Wrap=True)

loft = Loft(Curves=flatten(flip_matrix_2), Options=loft_options)  # -> simplify(Loft)
move = Move(Geometry=loft, DrumHeightVector=expr("x*-1", drum_height_vector))  # -> Geometry, Transform

geometry = ClusterOutput(move.Geometry)

# ==== cluster TurkishBand
polygon_side_number = ClusterInput()
wall_upper_rectangle = ClusterInput()
drum_height_vector = ClusterInput()
drum_upper_bound = ClusterInput()
drum_height_vector_2 = Vector(drum_height_vector)
drum_upper_bound_2 = Curve(drum_upper_bound)
polygon_side_number_2 = Number(polygon_side_number)
wall_upper_rectangle_2 = Curve(wall_upper_rectangle)

# ---- group: Planar Turkish Band
explode = Explode(DrumUpperBound=drum_upper_bound_2, Recursive=True)  # -> Segments, Vertices
divide_curve = DivideCurve(WallUpperRectangle=wall_upper_rectangle_2, PolygonSideNumber=polygon_side_number_2, Kinks=False)  # -> Points, Tangents, Parameters
list_length = ListLength(List=explode.Vertices)
expression = Expression(x=polygon_side_number_2, Expression="(x/8)*3")
expression_2 = Expression(x=polygon_side_number_2, Expression="(x/8)*3-1")
expression_3 = Expression(x=list_length, Expression="X-1")
split_list = SplitList(List=explode.Vertices, Index=expression_3)  # -> ListA, ListB
shift_list = ShiftList(List=divide_curve.Points, Shift=expression_2, Wrap=True)
shift_list_2 = ShiftList(List=divide_curve.Points, Shift=expression, Wrap=True)
number_slider = Slider(1, range=0..20)
list_item = ListItem(List=split_list.ListA, Index=number_slider, Wrap=True)
list_item_2 = ListItem(List=shift_list_2, Index=number_slider, Wrap=True)
line = Line(StartPoint=shift_list_2, EndPoint=split_list.ListA)
line_2 = Line(StartPoint=shift_list, EndPoint=split_list.ListA)
line_3 = Line([line, line_2])
sort_curves_along_crv = SortCurvesAlongCrv(Curves=line_3, GuideCrv=wall_upper_rectangle_2, CrvParam=0.5)  # -> SortedCurves, CurveIndex
list_length_2 = ListLength(List=sort_curves_along_crv.SortedCurves)
adding_first_curve_to_ent = ListItem(List=sort_curves_along_crv.SortedCurves, Index=Slider(0, range=0..100), Wrap=Toggle(False))
loft_options = LoftOptions(Closed=Toggle(True), Adjust=False, Rebuild=0, Refit=0, Type=Slider(3, range=0..10))
insert_items = InsertItems(List=sort_curves_along_crv.SortedCurves, Item=adding_first_curve_to_ent, Indices=list_length_2, Wrap=True)
planar_turkish_band = Loft(Curves=flatten(sort_curves_along_crv.SortedCurves), Options=loft_options)  # -> simplify(Loft)
move = Move(Geometry=planar_turkish_band, Motion=expr("x*-1", drum_height_vector_2))  # -> PlanarTurkishBand, Transform
checkig_sorted_curves = ListItem(List=insert_items, Index=Slider(32, range=0..100), Wrap=Toggle(False))

# ---- group: Basic Prismatic Turkish Band
# Creating Surfaces
# FIND NORMALS OF TRIANGLES
number_slider_2 = Slider(-1, range=-4..100)
list_length_3 = ListLength(List=shift_list_2)
series = Series(Start=number_slider_2, Step=Slider(1, range=0..1), Count=list_length_3)
series_2 = Series(Start=Slider(1, range=-4..100), Step=Slider(1, range=0..1), Count=list_length_3)
list_item_3 = ListItem(List=shift_list_2, Index=series, Wrap=True)
list_item_4 = ListItem(List=split_list.ListA, Index=series_2, Wrap=True)
stack_trees = StackTrees(Data0=shift_list_2, Data1=list_item_3, Data2=split_list.ListA, Reduce=True)
stack_trees_2 = StackTrees(Data0=split_list.ListA, Data1=list_item_4, Data2=shift_list_2, Reduce=True)
flip_matrix = FlipMatrix(Data=stack_trees)
flip_matrix_2 = FlipMatrix(Data=stack_trees_2)
list_item_5 = ListItem(List=stack_trees_2, Index=Slider(0, range=0..10), Wrap=True)
list_item_6 = ListItem(List=stack_trees, Index=Slider(0, range=0..10), Wrap=True)
average = Average(Input=flip_matrix)
average_2 = Average(Input=flip_matrix_2)
point = Point(average)
point_2 = Point(average_2)
deconstruct_brep = DeconstructBrep(Brep=planar_turkish_band)  # -> Faces, Edges, Vertices
panel = Panel("""TRUE
FALSE""")
panel_2 = Panel("""FALSE
TRUE""")
cull_pattern = CullPattern(List=deconstruct_brep.Faces, CullPattern=panel_2)
cull_pattern_2 = CullPattern(List=deconstruct_brep.Faces, CullPattern=panel)
expression_4 = Expression(x=polygon_side_number_2, Expression="(x/8)*3-1")
expression_5 = Expression(x=polygon_side_number_2, Expression="(x/8)*3-1")
shift_list_3 = ShiftList(List=cull_pattern_2, Shift=expression_4, Wrap=True)
shift_list_4 = ShiftList(List=cull_pattern, Shift=expression_5, Wrap=True)
deconstruct_plane = DeconstructPlane(Plane=shift_list_3)  # -> Origin, XAxis, YAxis, graft(ZAxis)
deconstruct_plane_2 = DeconstructPlane(Plane=shift_list_4)  # -> Origin, XAxis, YAxis, graft(ZAxis)
number_slider_3 = Slider(1, range=0..1)
list_item_7 = ListItem(List=shift_list_4, Index=number_slider_3, Wrap=True)
list_item_8 = ListItem(List=flatten(point_2), Index=number_slider_3, Wrap=True)
multiplication = Multiplication(A=deconstruct_plane_2.ZAxis, B=Slider(-5, range=-10..10))
multiplication_2 = Multiplication(A=deconstruct_plane.ZAxis, B=Slider(-5, range=-10..10))
move_2 = Move(Geometry=point_2, Motion=multiplication)  # -> Geometry, Transform
move_3 = Move(Geometry=point, Motion=multiplication_2)  # -> Geometry, Transform
vector_2pt = Vector2Pt(PointA=point_2, PointB=move_2.Geometry, Unitize=False)  # -> Vector, Length
vector_2pt_2 = Vector2Pt(PointA=point, PointB=move_3.Geometry, Unitize=False)  # -> Vector, Length
vector_display = VectorDisplay(Anchor=point_2, Vector=vector_2pt.Vector)
vector_display_2 = VectorDisplay(Anchor=point, Vector=vector_2pt_2.Vector)
line_4 = Line(StartPoint=move_3.Geometry, EndPoint=flip_matrix)  # -> simplify(Line)
line_5 = Line(StartPoint=move_2.Geometry, EndPoint=flip_matrix_2)  # -> simplify(Line)
list_item_9 = ListItem(List=line_4, Index=Slider(1, range=0..1), Wrap=True)
list_item_10 = ListItem(List=line_4, Index=Slider(1, range=0..1), Wrap=True)
list_item_11 = ListItem(List=line_4, Index=Slider(2, range=0..2), Wrap=True)
list_item_12 = ListItem(List=line_4, Index=Slider(2, range=0..2), Wrap=True)
list_item_13 = ListItem(List=line_4, Index=Slider(0, range=0..2), Wrap=True)
list_item_14 = ListItem(List=line_4, Index=Slider(0, range=0..1), Wrap=True)
list_item_15 = ListItem(List=line_5, Index=Slider(1, range=0..1), Wrap=True)
list_item_16 = ListItem(List=line_5, Index=Slider(1, range=0..1), Wrap=True)
list_item_17 = ListItem(List=line_5, Index=Slider(2, range=0..2), Wrap=True)
list_item_18 = ListItem(List=line_5, Index=Slider(2, range=0..2), Wrap=True)
list_item_19 = ListItem(List=line_5, Index=Slider(0, range=0..2), Wrap=True)
list_item_20 = ListItem(List=line_5, Index=Slider(0, range=0..1), Wrap=True)
loft = Loft(
    Curves=[list_item_14, list_item_9],
    Options={Adjust=False, Closed=False, LoftEnds=0, LoftSimp=0, LoftType=0, Rebuild=10, Refit=0.01})
loft_2 = Loft(
    Curves=[list_item_10, list_item_12],
    Options={Adjust=False, Closed=False, LoftEnds=0, LoftSimp=0, LoftType=0, Rebuild=10, Refit=0.01})
loft_3 = Loft(
    Curves=[list_item_11, list_item_13],
    Options={Adjust=False, Closed=False, LoftEnds=0, LoftSimp=0, LoftType=0, Rebuild=10, Refit=0.01})
loft_4 = Loft(
    Curves=[list_item_16, list_item_18],
    Options={Adjust=False, Closed=False, LoftEnds=0, LoftSimp=0, LoftType=0, Rebuild=10, Refit=0.01})
loft_5 = Loft(
    Curves=[list_item_17, list_item_19],
    Options={Adjust=False, Closed=False, LoftEnds=0, LoftSimp=0, LoftType=0, Rebuild=10, Refit=0.01})
loft_6 = Loft(
    Curves=[list_item_20, list_item_15],
    Options={Adjust=False, Closed=False, LoftEnds=0, LoftSimp=0, LoftType=0, Rebuild=10, Refit=0.01})
surface = Surface([loft, loft_2, loft_3, loft_6, loft_4, loft_5])
brep_join = BrepJoin(Breps=flatten(surface))  # -> Breps, Closed
move_4 = Move(Geometry=brep_join.Breps, Motion=expr("x*-1", drum_height_vector_2))  # -> BasicPrismaticTurkishBand, Transform

# ----
planar_turkish_band_2 = ClusterOutput(move.PlanarTurkishBand)
basic_prismatic_turkish_band = ClusterOutput(move_4.BasicPrismaticTurkishBand)

# ---- group: Complex Prismatic Turkish Band
# Creation of New Prismatic Triangle
# & Merging It With previous Triangles
# Inner Lines of the New Triangles
# Upper and Down Separetely
# Divide Upper and Lower Triangles
# Get Normals
# Move Centers of New Triangles
# Sort Planes
deconstruct_brep_2 = DeconstructBrep(Brep=brep_join.Breps)  # -> Faces, Edges, Vertices
number_slider_4 = Slider(-0.28, range=-1..2)
stack_trees_3 = StackTrees(Data0=shift_list_2, Data1=list_item_3, Reduce=True)
stack_trees_4 = StackTrees(Data0=split_list.ListA, Data1=list_item_4, Reduce=True)
list_item_21 = ListItem(List=line_4, Index=Slider(2, range=0..2), Wrap=True)
list_item_22 = ListItem(List=line_5, Index=Slider(2, range=0..2), Wrap=True)
evaluate_curve = EvaluateCurve(Curve=list_item_21, Parameter=number_slider_4)  # -> Point, Tangent, Angle
evaluate_curve_2 = EvaluateCurve(Curve=list_item_22, Parameter=number_slider_4)  # -> Point, Tangent, Angle
flip_matrix_3 = FlipMatrix(Data=stack_trees_4)
flip_matrix_4 = FlipMatrix(Data=stack_trees_3)
point_3 = Point([evaluate_curve.Point, evaluate_curve_2.Point])
gene_pool = GenePool(Decimals=0, Maximum=1, Minimum=0, Value=[1, 0, 0])
plane = Plane(deconstruct_brep_2.Faces)
cull_pattern_3 = CullPattern(List=plane, CullPattern=gene_pool)
flip_matrix_5 = FlipMatrix(Data=point_3)
area = Area(Geometry=cull_pattern_3)  # -> Area, Centroid
sort_along_curve = SortAlongCurve(Points=flatten(flip_matrix_5), Curve=drum_upper_bound_2)  # -> Points, Indices
sort_along_curve_2 = SortAlongCurve(Points=flatten(area.Centroid), Curve=drum_upper_bound_2)  # -> Points, Indices
list_item_23 = ListItem(List=cull_pattern_3, Index=sort_along_curve_2.Indices, Wrap=True)
shift_list_5 = ShiftList(List=list_item_23, Shift=Slider(2, range=0..10), Wrap=True)
deconstruct_plane_3 = DeconstructPlane(Plane=shift_list_5)  # -> Origin, XAxis, YAxis, graft(ZAxis)
multiplication_3 = Multiplication(A=deconstruct_plane_3.ZAxis, B=Slider(-5, range=-10..10))
move_5 = Move(Geometry=sort_along_curve.Points, Motion=flatten(multiplication_3))  # -> Geometry, Transform
gene_pool_2 = GenePool(Decimals=0, Maximum=1, Minimum=0, Value=[1, 0])
gene_pool_3 = GenePool(Decimals=0, Maximum=1, Minimum=0, Value=[0, 1])
cull_pattern_4 = CullPattern(List=move_5.Geometry, CullPattern=gene_pool_2)  # -> graft(List)
cull_pattern_5 = CullPattern(List=move_5.Geometry, CullPattern=gene_pool_3)  # -> graft(List)
center_points_of_lower_triangles = Point(simplify(move_3.Geometry))
shift_list_6 = ShiftList(List=flatten(center_points_of_lower_triangles), Shift=Slider(1, range=0..10), Wrap=True)  # -> graft(List)
point_4 = Point(simplify(flip_matrix_4))
shift_list_7 = ShiftList(List=flatten(point_4), Shift=Slider(2, range=0..10), Wrap=True)
divide_list = DivideList(List=shift_list_7, Number=polygon_side_number_2)  # -> Chunk, Remainder
line_6 = Line(StartPoint=cull_pattern_4, EndPoint=flip_matrix_3)
line_7 = Line(StartPoint=divide_list.Chunk, EndPoint=simplify(cull_pattern_5))
line_8 = Line(StartPoint=shift_list_6, EndPoint=cull_pattern_5)  # -> simplify(Line)
line_9 = Line(StartPoint=cull_pattern_4, EndPoint=move_2.Geometry)
list_item_24 = ListItem(List=line_6, Index=Slider(0, range=0..1), Wrap=True)
list_item_25 = ListItem(List=line_6, Index=Slider(1, range=0..1), Wrap=True)
list_item_26 = ListItem(List=line_7, Index=Slider(0, range=0..1), Wrap=True)
list_item_27 = ListItem(List=line_7, Index=Slider(1, range=0..1), Wrap=True)
loft_options_2 = LoftOptions(Closed=False, Adjust=False, Rebuild=0, Refit=0, Type=Slider(3, range=0..10))
loft_options_3 = LoftOptions(Closed=False, Adjust=False, Rebuild=0, Refit=0, Type=Slider(3, range=0..10))
loft_7 = Loft(Curves=simplify([list_item_24, line_9, list_item_25]), Options=loft_options_2)
loft_8 = Loft(Curves=line_7, Options={Adjust=False, Closed=False, LoftEnds=0, LoftSimp=0, LoftType=0, Rebuild=10, Refit=0.01})
loft_9 = Loft(Curves=line_6, Options={Adjust=False, Closed=False, LoftEnds=0, LoftSimp=0, LoftType=0, Rebuild=10, Refit=0.01})
loft_10 = Loft(Curves=simplify([list_item_26, line_8, list_item_27]), Options=loft_options_3)
lower_mid_triangles = Surface([loft_2, loft_3])
upper_mid_triangles = Surface([loft_4, loft_5])
brep = Brep(flatten([loft_10, lower_mid_triangles, loft_8, loft_7, upper_mid_triangles, loft_9]))

# ----
brep_join_2 = BrepJoin(Breps=brep)  # -> Breps, Closed

# ---- group: Complex Prismatic Turkish Band (continued)
move_6 = Move(Geometry=brep_join_2.Breps, Motion=expr("x*-1", drum_height_vector_2))  # -> ComplexPrismaticTurkishBand, Transform

# ----
complex_prismatic_turkish_band = ClusterOutput(move_6.ComplexPrismaticTurkishBand)

# ==== cluster FlatArchBasıkKemer
quarter_circle_or_free = ClusterInput()
depth_from_the_corner = ClusterInput()
wall_bottom_corners = ClusterInput()
height_of_the_arc = ClusterInput()
depth_of_arch = ClusterInput()
flatness_factor = ClusterInput()
wall_edges = ClusterInput()
wall_length = ClusterInput()
arch_thickness = ClusterInput()
depth_of_arch_2 = Number(depth_of_arch)
wall_edges_2 = Curve(wall_edges)
quarter_circle_or_free_2 = Boolean(quarter_circle_or_free)
flatness_factor_2 = Number(flatness_factor)
height_of_the_arc_2 = Number(height_of_the_arc)
wall_length_2 = Number(wall_length)
wall_bottom_corners_2 = Point(wall_bottom_corners)
depth_from_the_corner_2 = Number(depth_from_the_corner)
arch_thickness_2 = Number(arch_thickness)

# ----
# ARCH CREATION
number_slider = Slider(1, range=0..1)
shift_list = ShiftList(List=wall_bottom_corners_2, Shift=number_slider, Wrap=True)
shift_list_2 = ShiftList(List=wall_bottom_corners_2, Shift=Slider(-1, range=-1..5), Wrap=True)
vector_2pt = Vector2Pt(PointA=wall_bottom_corners_2, PointB=shift_list, Unitize=Toggle(True))  # -> Vector, Length
vector_2pt_2 = Vector2Pt(PointA=wall_bottom_corners_2, PointB=shift_list_2, Unitize=Toggle(True))  # -> Vector, Length
multiplication = Multiplication(A=vector_2pt.Vector, B=depth_from_the_corner_2)
multiplication_2 = Multiplication(A=vector_2pt_2.Vector, B=depth_from_the_corner_2)
multiplication_3 = Multiplication(A=depth_from_the_corner_2, B="2")
subtraction = Subtraction(WallLength=wall_length_2, B=multiplication_3)
move = Move(Geometry=wall_edges_2, Motion=multiplication_2)  # -> Geometry, Transform
move_2 = Move(Geometry=wall_edges_2, Motion=multiplication)  # -> Geometry, Transform
division = Division(A=subtraction, B="2")
construct_domain = ConstructDomain(DomainStart=Slider(0, range=0..100), DomainEnd=division)
expression = Expression(x=quarter_circle_or_free_2, Expression="if(x=true,0,1)")
slide_within_domain = SlideWithinDomain(Domain=construct_domain, FlatnessFactor=flatness_factor_2)
evaluate_length = EvaluateLength(Curve=move_2.Geometry, Length=height_of_the_arc_2, Normalized=Slider(0, range=0..1))  # -> Point, Tangent, Parameter
evaluate_length_2 = EvaluateLength(Curve=move.Geometry, Length=height_of_the_arc_2, Normalized=Slider(0, range=0..1))  # -> Point, Tangent, Parameter
shift_list_3 = ShiftList(List=evaluate_length_2.Point, Shift=Slider(1, range=0..10), Wrap=True)
addition = Addition(A=shift_list_3, B=evaluate_length.Point)
division_2 = Division(A=addition, B="2")
point = Point(division_2)
points_trim_curve = PointsTrimCurve(Curve=move.Geometry, Points=evaluate_length_2.Point, Flip=False)  # -> flatten(Trimmed), SubDomains, Intersected
points_trim_curve_2 = PointsTrimCurve(Curve=move_2.Geometry, Points=evaluate_length.Point, Flip=False)  # -> flatten(Trimmed), SubDomains, Intersected

expression_2 = Expression(x=division, Expression="sqrt(2)*x")
expression_3 = Expression(x=expression_2, Expression="x-(x/Sqrt(2))")

stream_filter = StreamFilter(Gate=expression, Stream0=expression_3, Stream1=slide_within_domain)  # -> simplify(Stream)
unit_z = UnitZ(Factor=stream_filter)
move_3 = Move(Geometry=point, Motion=unit_z)  # -> Geometry, Transform
arc_3pt = Arc3Pt(PointA=evaluate_length.Point, PointB=move_3.Geometry, PointC=shift_list_3)  # -> Arc, Plane, Radius

deconstruct_plane = DeconstructPlane(Plane=arc_3pt.Arc)  # -> Origin, XAxis, YAxis, ZAxis
shift_list_4 = ShiftList(List=points_trim_curve.Trimmed, Shift=Slider(1, range=0..10), Wrap=True)
multiplication_4 = Multiplication(A=deconstruct_plane.ZAxis, B="-1")
list_item = ListItem(List=[arc_3pt.Arc, shift_list_4, points_trim_curve_2.Trimmed], Index=Slider(0, range=0..10), Wrap=True)
list_item_2 = ListItem(List=[arc_3pt.Arc, shift_list_4, points_trim_curve_2.Trimmed], Index=Slider(1, range=0..10), Wrap=True)
list_item_3 = ListItem(List=[arc_3pt.Arc, shift_list_4, points_trim_curve_2.Trimmed], Index=Slider(3, range=0..10), Wrap=True)
list_item_4 = ListItem(List=[arc_3pt.Arc, shift_list_4, points_trim_curve_2.Trimmed], Index=Slider(2, range=0..10), Wrap=True)
join_curves = JoinCurves(Curves=flatten(list_item), Preserve=False)
join_curves_2 = JoinCurves(Curves=flatten(list_item_2), Preserve=False)
join_curves_3 = JoinCurves(Curves=flatten(list_item_4), Preserve=False)
join_curves_4 = JoinCurves(Curves=flatten(list_item_3), Preserve=False)
list_item_5 = ListItem(List=multiplication_4, Index=Slider(0, range=0..10), Wrap=True)
list_item_6 = ListItem(List=multiplication_4, Index=Slider(1, range=0..10), Wrap=True)
list_item_7 = ListItem(List=multiplication_4, Index=Slider(3, range=0..10), Wrap=True)
list_item_8 = ListItem(List=multiplication_4, Index=Slider(2, range=0..10), Wrap=True)
multiplication_5 = Multiplication(A=list_item_5, B=depth_of_arch_2)
multiplication_6 = Multiplication(A=list_item_6, B=depth_of_arch_2)
multiplication_7 = Multiplication(A=list_item_8, B=depth_of_arch_2)
multiplication_8 = Multiplication(A=list_item_7, B=depth_of_arch_2)
move_4 = Move(Geometry=join_curves, Motion=multiplication_5)  # -> flatten(Geometry), Transform
move_5 = Move(Geometry=join_curves_2, Motion=multiplication_6)  # -> flatten(Geometry), Transform
move_6 = Move(Geometry=join_curves_3, Motion=multiplication_7)  # -> flatten(Geometry), Transform
move_7 = Move(Geometry=join_curves_4, Motion=multiplication_8)  # -> flatten(Geometry), Transform
west_arch = Loft(
    Curves=flatten([join_curves_2, move_5.Geometry]),
    Options={Adjust=False, Closed=False, LoftEnds=0, LoftSimp=0, LoftType=0, Rebuild=10, Refit=0.01})
south_arch = Loft(
    Curves=flatten([join_curves_3, move_6.Geometry]),
    Options={Adjust=False, Closed=False, LoftEnds=0, LoftSimp=0, LoftType=0, Rebuild=10, Refit=0.01})
east_arch = Loft(
    Curves=flatten([join_curves_4, move_7.Geometry]),
    Options={Adjust=False, Closed=False, LoftEnds=0, LoftSimp=0, LoftType=0, Rebuild=10, Refit=0.01})
north_arch = Loft(
    Curves=flatten([join_curves, move_4.Geometry]),
    Options={Adjust=False, Closed=False, LoftEnds=0, LoftSimp=0, LoftType=0, Rebuild=10, Refit=0.01})

plane = Plane(arc_3pt.Plane)

# ---- group: Arch Interior Offset
curve_south = Curve(join_curves_3)
curve_east = Curve(join_curves_4)
curve_north = Curve(join_curves)
curve_west = Curve(join_curves_2)
list_item_9 = ListItem(List=plane, Index=Slider(1, range=0..10), Wrap=True)
list_item_10 = ListItem(List=plane, Index=Slider(0, range=0..10), Wrap=True)
list_item_11 = ListItem(List=plane, Index=Slider(2, range=0..10), Wrap=True)
list_item_12 = ListItem(List=plane, Index=Slider(3, range=0..10), Wrap=True)
offset_curve = OffsetCurve(Curve=curve_north, Distance=arch_thickness_2, Plane=list_item_10, Corners=1)
offset_curve_2 = OffsetCurve(Curve=curve_west, Distance=arch_thickness_2, Plane=list_item_9, Corners=1)
offset_curve_3 = OffsetCurve(Curve=curve_south, Distance=arch_thickness_2, Plane=list_item_11, Corners=1)
offset_curve_4 = OffsetCurve(Curve=curve_east, Distance=arch_thickness_2, Plane=list_item_12, Corners=1)
north_arch_2 = Loft(
    Curves=flatten([curve_north, offset_curve]),
    Options={Adjust=False, Closed=False, LoftEnds=0, LoftSimp=0, LoftType=0, Rebuild=10, Refit=0.01})
west_arch_2 = Loft(
    Curves=flatten([offset_curve_2, curve_west]),
    Options={Adjust=False, Closed=False, LoftEnds=0, LoftSimp=0, LoftType=0, Rebuild=10, Refit=0.01})
south_arch_2 = Loft(
    Curves=flatten([curve_south, offset_curve_3]),
    Options={Adjust=False, Closed=False, LoftEnds=0, LoftSimp=0, LoftType=0, Rebuild=10, Refit=0.01})
east_arch_2 = Loft(
    Curves=flatten([offset_curve_4, curve_east]),
    Options={Adjust=False, Closed=False, LoftEnds=0, LoftSimp=0, LoftType=0, Rebuild=10, Refit=0.01})

# ---- group: Arch Exterior Offset
curve_north_2 = Curve(move_4.Geometry)
curve_west_2 = Curve(move_5.Geometry)
curve_south_2 = Curve(move_6.Geometry)
curve_east_2 = Curve(move_7.Geometry)
list_item_13 = ListItem(List=plane, Index=Slider(0, range=0..10), Wrap=True)
list_item_14 = ListItem(List=plane, Index=Slider(1, range=0..10), Wrap=True)
list_item_15 = ListItem(List=plane, Index=Slider(2, range=0..10), Wrap=True)
list_item_16 = ListItem(List=plane, Index=Slider(3, range=0..10), Wrap=True)
offset_curve_5 = OffsetCurve(Curve=curve_north_2, Distance=arch_thickness_2, Plane=list_item_13, Corners=1)
offset_curve_6 = OffsetCurve(Curve=curve_west_2, Distance=arch_thickness_2, Plane=list_item_14, Corners=1)
offset_curve_7 = OffsetCurve(Curve=curve_south_2, Distance=arch_thickness_2, Plane=list_item_15, Corners=1)
offset_curve_8 = OffsetCurve(Curve=curve_east_2, Distance=arch_thickness_2, Plane=list_item_16, Corners=1)
west_arch_3 = Loft(
    Curves=flatten([offset_curve_6, curve_west_2]),
    Options={Adjust=False, Closed=False, LoftEnds=0, LoftSimp=0, LoftType=0, Rebuild=10, Refit=0.01})
north_arch_3 = Loft(
    Curves=flatten([curve_north_2, offset_curve_5]),
    Options={Adjust=False, Closed=False, LoftEnds=0, LoftSimp=0, LoftType=0, Rebuild=10, Refit=0.01})
south_arch_3 = Loft(
    Curves=flatten([curve_south_2, offset_curve_7]),
    Options={Adjust=False, Closed=False, LoftEnds=0, LoftSimp=0, LoftType=0, Rebuild=10, Refit=0.01})
east_arch_3 = Loft(
    Curves=flatten([offset_curve_8, curve_east_2]),
    Options={Adjust=False, Closed=False, LoftEnds=0, LoftSimp=0, LoftType=0, Rebuild=10, Refit=0.01})

# ---- group: Output Breps
south_arch_surface = BrepJoin(Breps=[south_arch, south_arch_3, south_arch_2])  # -> Breps, Closed
north_arch_surface = BrepJoin(Breps=[north_arch, north_arch_3, north_arch_2])  # -> Breps, Closed
west_arch_surface = BrepJoin(Breps=[west_arch, west_arch_3, west_arch_2])  # -> Breps, Closed
east_arch_surface = BrepJoin(Breps=[east_arch, east_arch_3, east_arch_2])  # -> Breps, Closed

# ----
breps = ClusterOutput(south_arch_surface.Breps)
breps_2 = ClusterOutput(north_arch_surface.Breps)
breps_3 = ClusterOutput(west_arch_surface.Breps)
breps_4 = ClusterOutput(east_arch_surface.Breps)

# ==== cluster Squinch
drum_bottom_bounds_8_16 = ClusterInput()
corners_of_upper_wall = ClusterInput()
square_corners = ClusterInput()
corners_of_upper_wall_2 = Point(corners_of_upper_wall)
drum_bottom_bounds_8_16_2 = Curve(drum_bottom_bounds_8_16)
square_corners_2 = Point(square_corners)
list_item = ListItem(List=flatten(drum_bottom_bounds_8_16_2), Index=0, Wrap=True)  # -> Item, Item1
polygon_edge_number = Number(Slider(8, range=0..10))
explode = Explode(DrumLowerBound=list_item.Item, Recursive=True)  # -> Segments, Vertices
expression = Expression(x=polygon_edge_number, Expression="(x/8)*3")
explode_2 = Explode(DrumLowerBound=list_item.Item1, Recursive=True)  # -> Segments, Vertices
shift_list = ShiftList(CornersOfUpperWall=corners_of_upper_wall_2, Shift=expression, Wrap=True)
list_length = ListLength(List=explode.Vertices)
list_item_2 = ListItem(List=explode.Segments, Index=Slider(1, range=0..1), Wrap=True)
expression_2 = Expression(x=list_length, Expression="X-1")
length = Length(Curve=list_item_2)
list_length_2 = ListLength(List=explode_2.Vertices)
list_item_3 = ListItem(List=explode_2.Segments, Index=Slider(1, range=0..1), Wrap=True)
expression_3 = Expression(x=list_length_2, Expression="X-1")
cull_duplicates = CullDuplicates(Points=shift_list, Tolerance=0.1, CullMode=3)  # -> Points, Indices, Valence
split_list = SplitList(List=explode.Vertices, Index=expression_2)  # -> ListA, ListB
length_2 = Length(Curve=list_item_3)
division = Division(A=length, B=Slider(2, range=0..10))
split_list_2 = SplitList(List=explode_2.Vertices, Index=expression_3)  # -> ListA, ListB
division_2 = Division(A=length_2, B=Slider(2, range=0..10))
unit_z = UnitZ(Factor=division)  # -> expr("x*-1", UnitVector)
expression_4 = Expression(x=Slider(8, range=0..10), Expression="if((x=8),3,if((x=16),13,if((x=32),1,if((x=48),14,0))) )")
unit_z_2 = UnitZ(Factor=division_2)  # -> expr("x*-1", UnitVector)
expression_5 = Expression(x=Slider(16, range=0..100), Expression="if((x=8),3,if((x=16),13,if((x=32),1,if((x=48),14,0))) )")
number_slider = Slider(0, range=0..20)
# Second Rim
number_slider_2 = Slider(4, range=0..10)
move = Move(Geometry=cull_duplicates.Points, Motion=unit_z)  # -> simplify(graft(Geometry)), Transform
# Squinch
list_item_4 = ListItem(List=shift_list, Index=number_slider, Wrap=True)
shift_list_2 = ShiftList(List=split_list.ListA, Shift=expression_4, Wrap=True)
shift_list_3 = ShiftList(List=shift_list_2, Shift=number_slider_2, Wrap=True)
point = Point(simplify(graft(shift_list_3)))
list_item_5 = ListItem(List=shift_list_2, Index=number_slider, Wrap=True)
move_2 = Move(Geometry=point, Motion=unit_z_2)  # -> simplify(Geometry), Transform
shift_list_4 = ShiftList(List=split_list_2.ListA, Shift=expression_5, Wrap=True)
divide_list = DivideList(List=shift_list_2, Number=Slider(4, range=0..10))  # -> Chunk, Remainder
flip_matrix = FlipMatrix(Data=divide_list.Chunk)
divide_list_2 = DivideList(List=shift_list_4, Number=Slider(8, range=0..10))  # -> Chunk, Remainder
move_3 = Move(Geometry=divide_list.Chunk, Motion=unit_z)  # -> simplify(Geometry), Transform
move_4 = Move(Geometry=divide_list_2.Chunk, Motion=unit_z_2)  # -> simplify(Geometry), Transform
list_item_6 = ListItem(List=flip_matrix, Index=Slider(0, range=0..20), Wrap=True)
average = Average(Input=divide_list.Chunk)
list_item_7 = ListItem(List=move_3.Geometry, Index=0, Wrap=True)  # -> Item, Item1
list_item_8 = ListItem(List=divide_list.Chunk, Index=0, Wrap=True)  # -> Item, Item1
average_2 = Average(Input=divide_list_2.Chunk)  # -> simplify(ArithmeticMean)
move_5 = Move(Geometry=average, Motion=unit_z)  # -> Geometry, Transform
point_2 = Point(graft(shift_list_3))
list_item_9 = ListItem(List=move_4.Geometry, Index=0, Wrap=True)  # -> Item, Item1
_4point_surface = _4PointSurface(CornerA=list_item_8.Item, CornerB=list_item_8.Item1, CornerC=list_item_7.Item1, CornerD=list_item_7.Item)  # -> simplify(Surface)
list_item_10 = ListItem(List=move_4.Geometry, Index=0, Wrap=True)  # -> Item, Item1
# Triple Squinch
list_item_11 = ListItem(List=divide_list_2.Chunk, Index=0, Wrap=True)  # -> Item, Item1
deconstruct_plane = DeconstructPlane(Plane=_4point_surface)  # -> Origin, XAxis, YAxis, ZAxis
_4point_surface_2 = _4PointSurface(CornerA=list_item_11.Item, CornerB=list_item_11.Item1, CornerC=list_item_10.Item1, CornerD=list_item_10.Item)  # -> simplify(Surface)
move_6 = Move(Geometry=average_2, Motion=unit_z_2)  # -> Geometry, Transform
vector_2pt = Vector2Pt(PointA=list_item_9.Item, PointB=list_item_9.Item1, Unitize=Toggle(True))  # -> Vector, Length
vector_2pt_2 = Vector2Pt(PointA=list_item_9.Item1, PointB=list_item_9.Item, Unitize=Toggle(True))  # -> Vector, Length
vector_2pt_3 = Vector2Pt(PointA=point_2, PointB=average_2, Unitize=Toggle(True))  # -> Vector, Length
deconstruct_plane_2 = DeconstructPlane(Plane=_4point_surface_2)  # -> Origin, XAxis, YAxis, ZAxis
circle_cnr = CircleCNR(Center=move_5.Geometry, Normal=deconstruct_plane.ZAxis, Radius=division)  # -> simplify(Circle)
area = Area(Geometry=circle_cnr)  # -> Area, Centroid
vector_display = VectorDisplay(Anchor=list_item_9.Item, Vector=vector_2pt.Vector)
vector_display_2 = VectorDisplay(Anchor=point_2, Vector=vector_2pt_3.Vector)
vector_display_3 = VectorDisplay(Anchor=list_item_9.Item1, Vector=vector_2pt_2.Vector)
rotate_3d = Rotate3D(Geometry=circle_cnr, Angle=1.570796327, Center=area.Centroid, Axis=Vector(0, 0, 1))  # -> Geometry, Transform
vector = Vector([vector_2pt.Vector, vector_2pt_2.Vector])
unit_z_3 = UnitZ(Factor=1)  # -> expr("x*-1", UnitVector)
curve_closest_point = CurveClosestPoint(Point=[average, move_3.Geometry], Curve=circle_cnr)  # -> Point, Parameter, Distance
subtraction = Subtraction(A=division_2, B=Slider(1, range=0..1))
curve_closest_point_2 = CurveClosestPoint(Point=[average, move.Geometry], Curve=rotate_3d.Geometry)  # -> Point, Parameter, Distance
circle_cnr_2 = CircleCNR(Center=move_6.Geometry, Normal=deconstruct_plane_2.ZAxis, Radius=subtraction)  # -> simplify(Circle)
move_7 = Move(Geometry=average_2, Motion=unit_z_3)  # -> Geometry, Transform
move_8 = Move(Geometry=move_4.Geometry, Motion=vector)  # -> Geometry, Transform
move_9 = Move(Geometry=move_2.Geometry, Motion=vector_2pt_3.Vector)  # -> simplify(Geometry), Transform
shatter = Shatter(Curve=circle_cnr, Parameters=curve_closest_point.Parameter)
number_slider_3 = Slider(1, range=0..1)
shatter_2 = Shatter(Curve=rotate_3d.Geometry, Parameters=curve_closest_point_2.Parameter)
length_3 = Length(Curve=shatter)
average_3 = Average(Input=length_3)
curve_closest_point_3 = CurveClosestPoint(Point=[move_8.Geometry, move_7.Geometry], Curve=circle_cnr_2)  # -> Point, Parameter, Distance
length_4 = Length(Curve=shatter_2)
smaller_than = SmallerThan(FirstNumber=length_3, SecondNumber=average_3)  # -> SmallerThan, OrEqualTo
list_item_12 = ListItem(List=move_8.Geometry, Index=0, Wrap=True)
list_item_13 = ListItem(List=move_4.Geometry, Index=0, Wrap=True)
list_item_14 = ListItem(List=move_8.Geometry, Index=number_slider_3, Wrap=True)
list_item_15 = ListItem(List=move_4.Geometry, Index=number_slider_3, Wrap=True)
average_4 = Average(Input=length_4)
shatter_3 = Shatter(Curve=circle_cnr_2, Parameters=curve_closest_point_3.Parameter)
_4point_surface_3 = _4PointSurface(CornerA=move_2.Geometry, CornerB=move_9.Geometry, CornerC=list_item_12, CornerD=list_item_13)
_4point_surface_4 = _4PointSurface(CornerA=move_2.Geometry, CornerB=move_9.Geometry, CornerC=list_item_14, CornerD=list_item_15)
average_5 = Average(Input=flatten(square_corners_2))
average_6 = Average(Input=cull_duplicates.Points)
length_5 = Length(Curve=shatter_3)
smaller_than_2 = SmallerThan(FirstNumber=length_4, SecondNumber=average_4)  # -> SmallerThan, OrEqualTo
cull_pattern = CullPattern(List=shatter, CullPattern=smaller_than.SmallerThan)
average_7 = Average(Input=length_5)
line = Line(StartPoint=average_5, EndPoint=average_6)
flip_curve = FlipCurve(Curve=cull_pattern, Guide=line)  # -> Curve, Flag
flip_curve_2 = FlipCurve(Curve=shatter_2, Guide=line)  # -> Curve, Flag
smaller_than_3 = SmallerThan(FirstNumber=length_5, SecondNumber=average_7)  # -> SmallerThan, OrEqualTo
average_8 = Average(Input=flatten(square_corners_2))
average_9 = Average(Input=cull_duplicates.Points)
list_item_16 = ListItem(List=flip_curve.Curve, Index=Slider(0, range=0..10), Wrap=True)  # -> Item, Item1
cull_pattern_2 = CullPattern(List=flip_curve_2.Curve, CullPattern=smaller_than_2.SmallerThan)
cull_pattern_3 = CullPattern(List=shatter_3, CullPattern=smaller_than_3.SmallerThan)
loft_options = LoftOptions(Closed=False, Adjust=Toggle(True), Rebuild=0, Refit=0, Type=Slider(3, range=0..10))
line_2 = Line(StartPoint=average_8, EndPoint=average_9)
list_item_17 = ListItem(List=move_3.Geometry, Index=0, Wrap=True)  # -> Item, Item1
list_item_18 = ListItem(List=divide_list.Chunk, Index=0, Wrap=True)  # -> Item, Item1
flip_curve_3 = FlipCurve(Curve=cull_pattern_3, Guide=line_2)  # -> simplify(Curve), Flag
point_3 = Point(simplify(graft(shift_list_3)))
point_4 = Point(move_9.Geometry)
point_5 = Point(move_7.Geometry)
line_3 = Line(StartPoint=list_item_18.Item, EndPoint=list_item_18.Item1)  # -> simplify(Line)
line_4 = Line(StartPoint=list_item_17.Item, EndPoint=list_item_17.Item1)  # -> simplify(Line)
nurbs_curve = NurbsCurve(Vertices=[point_4, point_3, point_5], Degree=Slider(2, range=0..10), Periodic=False)  # -> Curve, Length, Domain
loft = Loft(
    Curves=simplify([list_item_16.Item, cull_pattern_2]),
    Options={Adjust=False, Closed=False, LoftEnds=0, LoftSimp=0, LoftType=0, Rebuild=10, Refit=0.01})
loft_2 = Loft(Curves=simplify([cull_pattern_2, list_item_16.Item1]), Options=loft_options)
list_item_19 = ListItem(List=flip_curve_3.Curve, Index=Slider(0, range=0..10), Wrap=True)  # -> Item, Item1
loft_3 = Loft(
    Curves=[line_3, line_4],
    Options={Adjust=False, Closed=False, LoftEnds=0, LoftSimp=0, LoftType=0, Rebuild=10, Refit=0.01})
brep_join = BrepJoin(Breps=[loft, loft_2])  # -> simplify(Breps), Closed
loft_4 = Loft(
    Curves=[list_item_19.Item1, nurbs_curve.Curve],
    Options={Adjust=False, Closed=False, LoftEnds=0, LoftSimp=0, LoftType=0, Rebuild=10, Refit=0.01})
loft_5 = Loft(
    Curves=[list_item_19.Item, nurbs_curve.Curve],
    Options={Adjust=False, Closed=False, LoftEnds=0, LoftSimp=0, LoftType=0, Rebuild=10, Refit=0.01})
split_brep = SplitBrep(Brep=loft_3, Cutter=brep_join.Breps)
list_item_20 = ListItem(List=move_4.Geometry, Index=0, Wrap=True)  # -> Item, Item1
list_item_21 = ListItem(List=divide_list_2.Chunk, Index=0, Wrap=True)  # -> Item, Item1
brep_join_2 = BrepJoin(Breps=[loft_5, loft_4])  # -> Breps, Closed
line_5 = Line(StartPoint=list_item_21.Item, EndPoint=list_item_21.Item1)  # -> simplify(Line)
line_6 = Line(StartPoint=list_item_20.Item, EndPoint=list_item_20.Item1)  # -> simplify(Line)
list_item_22 = ListItem(List=split_brep, Index=Slider(1, range=0..1), Wrap=True)  # -> simplify(Item), simplify(Item1)
loft_options_2 = LoftOptions(Closed=False, Adjust=False, Rebuild=0, Refit=0, Type=Slider(3, range=0..10))
brep_join_3 = BrepJoin(Breps=[brep_join.Breps, list_item_22.Item, list_item_22.Item1])  # -> flatten(Breps), Closed
loft_6 = Loft(Curves=[line_5, line_6], Options=loft_options_2)
split_brep_2 = SplitBrep(Brep=loft_6, Cutter=brep_join_2.Breps)
breps = ClusterOutput(brep_join_3.Breps)
area_2 = Area(Geometry=split_brep_2)  # -> Area, Centroid
move_10 = Move(Geometry=brep_join_3.Breps, Motion=unit_z_2)  # -> Geometry, Transform
drum_lower_bound = Curve(simplify(list_item.Item1))
average_10 = Average(Input=area_2.Area)
move_11 = Move(Geometry=drum_lower_bound, Motion=unit_z_2)  # -> simplify(Geometry), Transform
# Joining BREPs as output Geometry
smaller_than_4 = SmallerThan(FirstNumber=area_2.Area, SecondNumber=average_10)  # -> SmallerThan, OrEqualTo
loft_7 = Loft(
    Curves=flatten([drum_lower_bound, move_11.Geometry]),
    Options={Adjust=False, Closed=False, LoftEnds=0, LoftSimp=0, LoftType=0, Rebuild=10, Refit=0.01})
cull_pattern_4 = CullPattern(List=split_brep_2, CullPattern=smaller_than_4.SmallerThan)
split_brep_multiple = SplitBrepMultiple(Brep=loft_7, Cutters=flatten(loft_6))
area_3 = Area(Geometry=split_brep_multiple)  # -> Area, Centroid
sort_along_curve = SortAlongCurve(Points=area_3.Centroid, Curve=move_11.Geometry)  # -> Points, Indices
list_item_23 = ListItem(List=split_brep_multiple, Index=sort_along_curve.Indices, Wrap=True)
gene_pool = GenePool(Decimals=0, Maximum=1, Minimum=0, Value=[1, 0])
cull_pattern_5 = CullPattern(List=list_item_23, CullPattern=gene_pool)
brep_join_4 = BrepJoin(Breps=flatten([move_10.Geometry, _4point_surface_3, cull_pattern_4, brep_join_2.Breps, _4point_surface_4, cull_pattern_5]))  # -> Breps, Closed
breps_2 = ClusterOutput(brep_join_4.Breps)

# ==== cluster DomeForm
dome_flatness_ratio = ClusterInput()
dome_radius = ClusterInput()
dome_type = ClusterInput()
dome_radius_2 = Number(dome_radius)
dome_flatness_ratio_2 = Number(dome_flatness_ratio)
dome_type_2 = Number(dome_type)
drummer_upper_circle = ClusterInput()
drum_lower_circle = ClusterInput()

# ---- group: Flat Dome Without Drum
expression = Expression(x=dome_type_2, Expression="if(x=0,0,1)")
semicircle = Panel("1")
drum_lower_circle_2 = Circle(drum_lower_circle)
drum_type = StreamFilter(Gate=expression, Stream0=semicircle, Stream1=dome_flatness_ratio_2)
length = Length(Curve=drum_lower_circle_2)
length_2 = Length(Curve=drum_lower_circle_2)
multiplication = Multiplication(A=dome_radius_2, B=drum_type)
multiplication_2 = Multiplication(A=length, B=Slider(0.5, range=0..1))
multiplication_3 = Multiplication(A=length_2, B=Slider(0, range=0..1))
unit_z = UnitZ(Factor=multiplication)
evaluate_curve = EvaluateCurve(Curve=drum_lower_circle_2, Parameter=multiplication_2)  # -> Point, Tangent, Angle
evaluate_curve_2 = EvaluateCurve(Curve=drum_lower_circle_2, Parameter=multiplication_3)  # -> Point, Tangent, Angle
move = Move(DrumBottomCircle=drum_lower_circle_2, Motion=unit_z)  # -> Geometry, Transform
arc_3pt = Arc3Pt(PointA=evaluate_curve_2.Point, PointB=move.Geometry, PointC=evaluate_curve.Point)  # -> Arc, Plane, Radius
rotate = Rotate(Geometry=arc_3pt.Arc, Angle=1.570796327, Plane=PlaneXY(0, 0, 0))  # -> Geometry, Transform
curve_curve = CurveCurve(CurveA=arc_3pt.Arc, CurveB=rotate.Geometry)  # -> Points, ParamsA, ParamsB
curve_closest_point = CurveClosestPoint(Point=curve_curve.Points, Curve=[arc_3pt.Arc, rotate.Geometry])  # -> Point, Parameter, Distance
shatter = Shatter(Curve=[arc_3pt.Arc, rotate.Geometry], Parameters=curve_closest_point.Parameter)  # -> flatten(Segments)
list_item = ListItem(List=shatter, Index=0, Wrap=True)
sweep1 = Sweep1(Rail=drum_lower_circle_2, Sections=list_item, Miter=1)

# ----
semicircle_2 = Panel("1")

# ---- group: Flat Dome with drum
expression_2 = Expression(x=dome_type_2, Expression="if(x=0,0,1)")
drummer_upper_circle_2 = Circle(drummer_upper_circle)
drum_type_2 = StreamFilter(Gate=expression_2, Stream0=semicircle_2, Stream1=dome_flatness_ratio_2)
length_3 = Length(Curve=drummer_upper_circle_2)
length_4 = Length(Curve=drummer_upper_circle_2)
multiplication_4 = Multiplication(A=dome_radius_2, B=drum_type_2)
multiplication_5 = Multiplication(A=length_3, B=Slider(0.5, range=0..1))
multiplication_6 = Multiplication(A=length_4, B=Slider(0, range=0..1))
unit_z_2 = UnitZ(Factor=multiplication_4)
evaluate_curve_3 = EvaluateCurve(Curve=drummer_upper_circle_2, Parameter=multiplication_5)  # -> Point, Tangent, Angle
evaluate_curve_4 = EvaluateCurve(Curve=drummer_upper_circle_2, Parameter=multiplication_6)  # -> Point, Tangent, Angle
move_2 = Move(Geometry=drummer_upper_circle_2, Motion=unit_z_2)  # -> Geometry, Transform
arc_3pt_2 = Arc3Pt(PointA=evaluate_curve_4.Point, PointB=move_2.Geometry, PointC=evaluate_curve_3.Point)  # -> Arc, Plane, Radius
rotate_2 = Rotate(Geometry=arc_3pt_2.Arc, Angle=1.570796327, Plane=PlaneXY(0, 0, 0))  # -> Geometry, Transform
curve_curve_2 = CurveCurve(CurveA=arc_3pt_2.Arc, CurveB=rotate_2.Geometry)  # -> Points, ParamsA, ParamsB
curve_closest_point_2 = CurveClosestPoint(Point=curve_curve_2.Points, Curve=[arc_3pt_2.Arc, rotate_2.Geometry])  # -> Point, Parameter, Distance
shatter_2 = Shatter(Curve=[arc_3pt_2.Arc, rotate_2.Geometry], Parameters=curve_closest_point_2.Parameter)  # -> flatten(Segments)
list_item_2 = ListItem(List=shatter_2, Index=0, Wrap=True)
sweep1_2 = Sweep1(Rail=drummer_upper_circle_2, Sections=list_item_2, Miter=1)

# ----
dome_with_drum = ClusterOutput(sweep1_2)
dome_without_drum = ClusterOutput(sweep1)
